# Grasshopper definition DomainSimple.gh (Grasshopper 1.0.7)
# plug-ins: GH_CPython

multiplication = Multiplication(A="255", B=1000)
multiplication_2 = Multiplication(A="210000", B=1000)
num = Number("500/1.15")
num_2 = Number("-20/1.0")
multiplication_3 = Multiplication(A=num, B=1000)
panel = Panel("-14.17")
panel_3 = Panel("-0.0035")
panel_4 = Panel("392.1")
toggle = BooleanToggle(False)
multiplication_4 = Multiplication(A="-10.46", B=1000)
multiplication_5 = Multiplication(A="-12.47", B=1000)
multiplication_6 = Multiplication(A=num_2, B=1000)
multiplication_7 = Multiplication(A=num_2, B=1000)
multiplication_8 = Multiplication(A="1000.00", B=1000)
multiplication_9 = Multiplication(A="469.56", B=1000)
multiplication_10 = Multiplication(A="3.0", B=1000)
multiplication_11 = Multiplication(A="391.3", B=1000)
multiplication_12 = Multiplication(A="200000.0", B=1000)
multiplication_13 = Multiplication(A="0.0", B=1000)
uemc01 = UniaxialElasticMaterialConcreate01Alpaca4d(MinMaxLimit=toggle, fc=multiplication_6, fcu=multiplication_7, ec0="-0.002", ecu="-0.0035")  # -> out, uniAxialMaterial; inputs MinMaxLimit: Boolean
# ---------- uemc01: Python ----------
"""
Create a uniaxial Elastic Material Concreate01
-
    Args:
        fc:
        fcu:
        ec0:
        ecu:
    Returns:
        uniAxialMaterial:
"""

__author__ = "Ing. Domenico Gaudioso"
__contact__ = "DomenicoGaudioso@outlook.it"
__version__ = "2021.09.17"

ghenv.Component.Name = "uniaxial Elastic Material Concreate01 (Alpaca4d)"
ghenv.Component.NickName = 'UEMC01'
ghenv.Component.Message = "uniaxial Concreate01 (Alpaca4d)"

import sys
import Rhino.Geometry as rg
import Grasshopper as gh
import copy


## add alpaca install directory to system path

ghcompfolder = gh.Folders.DefaultAssemblyFolder
if ghcompfolder not in sys.path:
    sys.path.append(ghcompfolder)

try:
    from Alpaca4d import alpaca4d as alpaca
except:
    msg = "Cannot import Alpaca4d. Is the Alpaca4d folder available in " + ghcompfolder + "?"
    ghenv.Component.AddRuntimeMessage(gh.Kernel.GH_RuntimeMessageLevel.Error, msg)


checkData = True

if not fc:
    checkData = False
    msg = "Input parameter fc failed to collect data"
    ghenv.Component.AddRuntimeMessage(gh.Kernel.GH_RuntimeMessageLevel.Warning, msg)

if fcu == 'None':
    checkData = False
    msg = "Input parameter fcu failed to collect data"
    ghenv.Component.AddRuntimeMessage(gh.Kernel.GH_RuntimeMessageLevel.Warning, msg)

if not ec0:
    checkData = False
    msg = "Input parameter ec0 failed to collect data"
    ghenv.Component.AddRuntimeMessage(gh.Kernel.GH_RuntimeMessageLevel.Warning, msg)

if not ecu:
    checkData = False
    msg = "Input parameter ecu failed to collect data"
    ghenv.Component.AddRuntimeMessage(gh.Kernel.GH_RuntimeMessageLevel.Warning, msg)


class uniAxialMaterialConcreate01(object):
    def __init__(self, matName, MinMaxLimit, fc, ec0, fcu, ecu):
        '''Generate a uniaxial Elastic Material Concreate01
            link for information: https://opensees.berkeley.edu/wiki/index.php/Concrete01_Material_--_Zero_Tensile_Strength
            Inputs:
                matName: Name of the material.
                fc:  concrete compressive strength at 28 days (compression is negative) [MPa].
                fcu: concrete crushing strength[MPa].
                ec0: concrete strain at maximum strength.
                ecu: concrete strain at crushing strength.'''


        self.matName = matName
        self.MinMaxLimit = MinMaxLimit
        self.fc = fc
        self.fcu = fcu
        self.ec0 = ec0
        self.ecu = ecu
        self.tensionLimitPositive = 0.0
        self.tensionLimitNegative = self.fcu
        self.matTag = None
        self.matTagMinMax = None
        
        self.materialDimension = "uniAxialMaterial"
        self.materialType = "Concrete01"

    def ToString(self):
        return self.write_tcl()

    def write_tcl(self):
        a = "uniaxialMaterial Concrete01 {} {} {} {} {}\n".format(self.matTag, self.fc, self.ec0, self.fcu, self.ecu)
        b = "uniaxialMaterial MinMax {} {} -min {} -max {}\n".format(self.matTagMinMax, self.matTag, self.ecu, 0.0)
        if MinMaxLimit == True :
            return a + b
        else :
            return a
            
        
    def write_py(self):
        return "ops.uniaxialMaterial('Concrete01', {}, {}, {}, {}, {})\n".format(self.matTag, self.fc, self.ec0, self.fcu, self.ecu)


if checkData:
    uniAxialMaterial = uniAxialMaterialConcreate01(name, MinMaxLimit, fc, ec0, fcu, ecu)
# ---------- end uemc01 ----------
uemc02 = UniaxialElasticMaterialConcreate02Alpaca4d(
    MinMaxLimit=toggle,
    fpc=multiplication_5,
    fpcu=multiplication_4,
    epc0="-0.002",
    epcu="-0.0035",
    lambd="0.1",
    ft=multiplication_10,
    Ets=multiplication_8)  # -> out, uniAxialMaterial; inputs MinMaxLimit: Boolean
# ---------- uemc02: Python ----------
"""
Create a uniaxial Elastic Material Concreate01
-
    Args:
        fpc: concrete compressive strength at 28 days (compression is negative)*
        fpcu: concrete crushing strength *
        epc0: concrete strain at maximum strength*
        epcu: concrete strain at crushing strength*
        lambd: ratio between unloading slope at $epscu and initial slope
        ft:	tensile strength
        Ets: tension softening stiffness (absolute value) (slope of the linear tension softening branch)

    Returns:
        uniAxialMaterial:
"""

__author__ = "Ing. Domenico Gaudioso"
__contact__ = "DomenicoGaudioso@outlook.it"
__version__ = "2021.09.17"


ghenv.Component.Name = "uniaxial Elastic Material Concreate02 (Alpaca4d)"
ghenv.Component.NickName = 'UEMC02'
ghenv.Component.Message = "uniaxial Concreate02 (Alpaca4d)"

import sys
import Rhino.Geometry as rg
import Grasshopper as gh
import copy


## add alpaca install directory to system path

ghcompfolder = gh.Folders.DefaultAssemblyFolder
if ghcompfolder not in sys.path:
    sys.path.append(ghcompfolder)

try:
    from Alpaca4d import alpaca4d as alpaca
except:
    msg = "Cannot import Alpaca4d. Is the Alpaca4d folder available in " + ghcompfolder + "?"
    ghenv.Component.AddRuntimeMessage(gh.Kernel.GH_RuntimeMessageLevel.Error, msg)


checkData = True

if not fpc:
    checkData = False
    msg = "Input parameter fpc failed to collect data"
    ghenv.Component.AddRuntimeMessage(gh.Kernel.GH_RuntimeMessageLevel.Warning, msg)

if fpcu == 'None':
    checkData = False
    msg = "Input parameter fpcu failed to collect data"
    ghenv.Component.AddRuntimeMessage(gh.Kernel.GH_RuntimeMessageLevel.Warning, msg)

if not epc0:
    checkData = False
    msg = "Input parameter epc0 failed to collect data"
    ghenv.Component.AddRuntimeMessage(gh.Kernel.GH_RuntimeMessageLevel.Warning, msg)

if not epcu:
    checkData = False
    msg = "Input parameter epcu failed to collect data"
    ghenv.Component.AddRuntimeMessage(gh.Kernel.GH_RuntimeMessageLevel.Warning, msg)

if not lambd:
    checkData = False
    msg = "Input parameter lambd failed to collect data"
    ghenv.Component.AddRuntimeMessage(gh.Kernel.GH_RuntimeMessageLevel.Warning, msg)

if not ft:
    checkData = False
    msg = "Input parameter ft failed to collect data"
    ghenv.Component.AddRuntimeMessage(gh.Kernel.GH_RuntimeMessageLevel.Warning, msg)

if not Ets:
    checkData = False
    msg = "Input parameter Ets failed to collect data"
    ghenv.Component.AddRuntimeMessage(gh.Kernel.GH_RuntimeMessageLevel.Warning, msg)
    

class uniAxialMaterialConcreate02(object):
    def __init__(self, matName, MinMaxLimit, fpc, epc0, fpcu, epcu, lambd, ft, Ets):
        """Generate a uniaxial Elastic Material Concreate02
            link for information: https://opensees.berkeley.edu/wiki/index.php/Concrete02_Material_--_Linear_Tension_Softening
            Inputs:
                fpc: concrete compressive strength at 28 days (compression is negative)*
                fpcu: concrete crushing strength *
                epc0: concrete strain at maximum strength*
                epcu: concrete strain at crushing strength*
                lambd: ratio between unloading slope at $epscu and initial slope
                ft:	tensile strength
                Ets: tension softening stiffness (absolute value) (slope of the linear tension softening branch)
         """


        self.matName = matName
        self.MinMaxLimit = MinMaxLimit
        self.fpc = fpc
        self.fpcu = fpcu
        self.epc0 = epc0
        self.epcu = epcu
        self.lambd = lambd
        self.ft = ft
        self.Ets = Ets
        self.tensionLimitPositive = self.ft
        self.tensionLimitNegative = self.fpcu
        self.matTag = None
        self.matTagMinMax = None
        
        self.materialDimension = "uniAxialMaterial"
        self.materialType = "Concrete02"

    def ToString(self):
        return self.write_tcl()

    def write_tcl(self):
        a = "uniaxialMaterial Concrete02 {} {} {} {} {} {} {} {}\n".format(self.matTag, self.fpc, self.epc0, self.fpcu, self.epcu, self.lambd, self.ft, self.Ets)
        b = "uniaxialMaterial MinMax {} {} -min {} -max {}\n".format(self.matTagMinMax, self.matTag, self.epcu, self.ft/self.Ets)
        if MinMaxLimit == True:
            return a + b
        else :
            return a
        
    def write_py(self):
        return "ops.uniaxialMaterial('Concrete02', {}, {}, {}, {}, {})\n".format(self.matTag, self.fc, self.ec0, self.fcu, self.ecu)


if checkData:
    uniAxialMaterial = uniAxialMaterialConcreate02(name, MinMaxLimit, fpc, epc0, fpcu, epcu, lambd, ft, Ets)
# ---------- end uemc02 ----------
uems01 = UniaxialElasticMaterialSteel01Alpaca4d(fy=multiplication_3, E0=multiplication_2, b="0.0")  # -> out, uniAxialMaterial; inputs MinMaxLimit: Boolean
# ---------- uems01: Python ----------
"""
Create a uniaxial Elastic Material Concreate01
-
    Args:
        fc:
        fcu:
        ec0:
        ecu:
    Returns:
        uniAxialMaterial:
"""

ghenv.Component.Name = "uniaxial Elastic Material Steel01 (Alpaca4d)"
ghenv.Component.NickName = 'UEMS01'
ghenv.Component.Message = "uniaxial Steel01 (Alpaca4d)"

import sys
import Rhino.Geometry as rg
import Grasshopper as gh
import copy


## add alpaca install directory to system path

ghcompfolder = gh.Folders.DefaultAssemblyFolder
if ghcompfolder not in sys.path:
    sys.path.append(ghcompfolder)


   
   
try:
    from Alpaca4d import alpaca4d as alpaca
except:
    msg = "Cannot import Alpaca4d. Is the Alpaca4d folder available in " + ghcompfolder + "?"
    ghenv.Component.AddRuntimeMessage(gh.Kernel.GH_RuntimeMessageLevel.Error, msg)

print(a1!=None, a2, a3, a4)

checkData = True

if not fy:
    checkData = False
    msg = "Input parameter fy failed to collect data"
    ghenv.Component.AddRuntimeMessage(gh.Kernel.GH_RuntimeMessageLevel.Warning, msg)

if not E0:
    checkData = False
    msg = "Input parameter E0 failed to collect data"
    ghenv.Component.AddRuntimeMessage(gh.Kernel.GH_RuntimeMessageLevel.Warning, msg)
"""
if not b:
    checkData = False
    msg = "Input parameter b failed to collect data"
    ghenv.Component.AddRuntimeMessage(gh.Kernel.GH_RuntimeMessageLevel.Warning, msg)
"""

class uniAxialMaterialSteel01(object):
    def __init__(self, matName, MinMaxLimit, fy, E0, b, a1, a2, a3, a4):
        '''Generate a uniaxial Elastic Material Steel01
            link for information: https://opensees.berkeley.edu/wiki/index.php/Steel01_Material
            Inputs:
                matName: Name of the material.
                fy: yield strength [MPa].
                E0: initial elastic tangent[MPa].
                b: strain-hardening ratio (ratio between post-yield tangent and initial elastic tangent).
                a1: isotropic hardening parameter, increase of compression yield envelope as proportion of yield strength after a plastic strain of $a2*($Fy/E0). (optional).
                a2: isotropic hardening parameter (see explanation under $a1). (optional).
                a3: isotropic hardening parameter, increase of tension yield envelope as proportion of yield strength after a plastic strain of $a4*($Fy/E0). (optional)
                a4: isotropic hardening parameter (see explanation under $a3). (optional)'''

        self.matName = matName
        self.MinMaxLimit = MinMaxLimit
        self.fy = fy
        self.E0 = E0
        self.b = b
        self.a1 = a1
        self.a2 = a2
        self.a3 = a3
        self.a4 = a4
        
        self.tensionLimitPositive = self.fy
        self.tensionLimitNegative = -self.fy
        
        self.matTag = None
        self.matTagMinMax = None
        
        self.materialDimension = "uniAxialMaterial"
        self.materialType = "Steel01"
        
        self.esh = self.fy/self.E0
        self.eult = 6.75/100

    def ToString(self):
        return self.write_tcl()

    def write_tcl(self):
        if a1 != None and a2 == None and a3 == None and a4 == None:
            return "uniaxialMaterial Steel01 {} {} {} {} {}\n".format(self.matTag, self.fy, self.E0, self.b, self.a1)
        elif a1 != None and a2 != None and a3 == None and a4 == None:
            return "uniaxialMaterial Steel01 {} {} {} {} {} {}\n".format(self.matTag, self.fy, self.E0, self.b, self.a1, self.a2) 
        elif a1 != None and a2 != None and a3 != None and a4 == None:
            return "uniaxialMaterial Steel01 {} {} {} {} {} {} {}\n".format(self.matTag, self.fy, self.E0, self.b, self.a1, self.a2, self.a3) 
        elif a1 == None and a2 == None and a3 == None and a4 == None and self.MinMaxLimit== None:
            return "uniaxialMaterial Steel01 {} {} {} {}\n".format(self.matTag, self.fy, self.E0, self.b) 
        elif self.a1 == None and self.a2 == None and self.a3 == None and self.a4 == None and self.MinMaxLimit== True:            
            a = "uniaxialMaterial Steel01 {} {} {} {}\n".format(self.matTag, self.fy, self.E0, self.b)
            b = "uniaxialMaterial MinMax {} {} -min {} -max {}\n".format(self.matTagMinMax, self.matTag, -self.eult, self.eult)
            return a + b
    def write_py(self):
        if a1 != None and a2 == None and a3 == None and a4 == None:
            return "ops.uniaxialMaterial('Steel01', {}, {}, {}, {}, {})\n".format(self.matTag, self.fy, self.E0, self.b, self.a1)
        elif a1 != None and a2 != None and a3 == None and a4 == None:
            return "ops.uniaxialMaterial('Steel01', {}, {}, {}, {}, {}, {})\n".format(self.matTag, self.fy, self.E0, self.b, self.a1, self.a2) 
        elif a1 != None and a2 != None and a3 != None and a4 == None:
            return "ops.uniaxialMaterial('Steel01', {}, {}, {}, {}, {}, {}, {})\n".format(self.matTag, self.fy, self.E0, self.b, self.a1, self.a2, self.a3) 
        elif a1 != None and a2 != None and a3 != None and a4 != None:
            return "ops.uniaxialMaterial('Steel01', {}, {}, {}, {}, {}, {}, {}, {})\n".format(self.matTag, self.fy, self.E0, self.b, self.a1, self.a2, self.a3,  self.a4) 
        else:
            return "ops.uniaxialMaterial('Steel01', {}, {}, {}, {})\n".format(self.matTag, self.fy, self.E0, self.b)


if checkData:
    uniAxialMaterial = uniAxialMaterialSteel01(name, MinMaxLimit, fy, E0, b, a1, a2, a3, a4)


"""
class uniAxialMaterialSteel01(object):
    def __init__(self, matName, fy, E0, b, a1, a2, a3, a4):
        '''Generate a uniaxial Elastic Material Steel01
            link for information: https://opensees.berkeley.edu/wiki/index.php/Steel01_Material
            Inputs:
                matName: Name of the material.
                fy: yield strength [MPa].
                E0: initial elastic tangent[MPa].
                b: strain-hardening ratio (ratio between post-yield tangent and initial elastic tangent).
                a1: isotropic hardening parameter, increase of compression yield envelope as proportion of yield strength after a plastic strain of $a2*($Fy/E0). (optional).
                a2: isotropic hardening parameter (see explanation under $a1). (optional).
                a3: isotropic hardening parameter, increase of tension yield envelope as proportion of yield strength after a plastic strain of $a4*($Fy/E0). (optional)
                a4: isotropic hardening parameter (see explanation under $a3). (optional)'''

        self.matName = matName
        self.fy = fy
        self.E0 = E0
        self.b = b
        self.a1 = a1
        self.a2 = a2
        self.a3 = a3
        self.a4 = a4

        self.matTag = None

        self.materialDimension = "uniAxialMaterial"
        self.materialType = "Steel01"

    def ToString(self):
        return self.write_tcl()

    def write_tcl(self):
        if a1 != None and a2 == None and a3 == None and a4 == None:
            return "uniaxialMaterial Steel01 {} {} {} {} {}\n".format(self.matTag, self.fy, self.E0, self.b, self.a1)
        elif a1 != None and a2 != None and a3 == None and a4 == None:
            return "uniaxialMaterial Steel01 {} {} {} {} {} {}\n".format(self.matTag, self.fy, self.E0, self.b, self.a1, self.a2) 
        elif a1 != None and a2 != None and a3 != None and a4 == None:
            return "uniaxialMaterial Steel01 {} {} {} {} {} {} {}\n".format(self.matTag, self.fy, self.E0, self.b, self.a1, self.a2, self.a3) 
        elif a1 != None and a2 != None and a3 != None and a4 != None:
            return "uniaxialMaterial Steel01 {} {} {} {} {} {} {} {}\n".format(self.matTag, self.fy, self.E0, self.b, self.a1, self.a2, self.a3,  self.a4) 
        else:
            return "uniaxialMaterial Steel01 {} {} {} {}\n".format(self.matTag, self.fy, self.E0, self.b)
    def write_py(self):
        if a1 != None and a2 == None and a3 == None and a4 == None:
            return "ops.uniaxialMaterial('Steel01', {}, {}, {}, {}, {})\n".format(self.matTag, self.fy, self.E0, self.b, self.a1)
        elif a1 != None and a2 != None and a3 == None and a4 == None:
            return "ops.uniaxialMaterial('Steel01', {}, {}, {}, {}, {}, {})\n".format(self.matTag, self.fy, self.E0, self.b, self.a1, self.a2) 
        elif a1 != None and a2 != None and a3 != None and a4 == None:
            return "ops.uniaxialMaterial('Steel01', {}, {}, {}, {}, {}, {}, {})\n".format(self.matTag, self.fy, self.E0, self.b, self.a1, self.a2, self.a3) 
        elif a1 != None and a2 != None and a3 != None and a4 != None:
            return "ops.uniaxialMaterial('Steel01', {}, {}, {}, {}, {}, {}, {}, {})\n".format(self.matTag, self.fy, self.E0, self.b, self.a1, self.a2, self.a3,  self.a4) 
        else:
            return "ops.uniaxialMaterial('Steel01', {}, {}, {}, {})\n".format(self.matTag, self.fy, self.E0, self.b)
"""
# ---------- end uems01 ----------
uems01_2 = UniaxialElasticMaterialSteel01Alpaca4d(MinMaxLimit=toggle, fy=multiplication, E0=multiplication_2, b="0.0")  # -> out, uniAxialMaterial; inputs MinMaxLimit: Boolean
# ---------- uems01_2: Python ----------
"""
Create a uniaxial Elastic Material Concreate01
-
    Args:
        fc:
        fcu:
        ec0:
        ecu:
    Returns:
        uniAxialMaterial:
"""

__author__ = "Ing. Domenico Gaudioso"
__contact__ = "DomenicoGaudioso@outlook.it"
__version__ = "2021.09.17"

ghenv.Component.Name = "uniaxial Elastic Material Steel01 (Alpaca4d)"
ghenv.Component.NickName = 'UEMS01'
ghenv.Component.Message = "uniaxial Steel01 (Alpaca4d)"

import sys
import Rhino.Geometry as rg
import Grasshopper as gh
import copy


## add alpaca install directory to system path

ghcompfolder = gh.Folders.DefaultAssemblyFolder
if ghcompfolder not in sys.path:
    sys.path.append(ghcompfolder)


   
   
try:
    from Alpaca4d import alpaca4d as alpaca
except:
    msg = "Cannot import Alpaca4d. Is the Alpaca4d folder available in " + ghcompfolder + "?"
    ghenv.Component.AddRuntimeMessage(gh.Kernel.GH_RuntimeMessageLevel.Error, msg)

print(a1!=None, a2, a3, a4)

checkData = True

if not fy:
    checkData = False
    msg = "Input parameter fy failed to collect data"
    ghenv.Component.AddRuntimeMessage(gh.Kernel.GH_RuntimeMessageLevel.Warning, msg)

if not E0:
    checkData = False
    msg = "Input parameter E0 failed to collect data"
    ghenv.Component.AddRuntimeMessage(gh.Kernel.GH_RuntimeMessageLevel.Warning, msg)
"""
if not b:
    checkData = False
    msg = "Input parameter b failed to collect data"
    ghenv.Component.AddRuntimeMessage(gh.Kernel.GH_RuntimeMessageLevel.Warning, msg)
"""

class uniAxialMaterialSteel01(object):
    def __init__(self, matName, MinMaxLimit, fy, E0, b, a1, a2, a3, a4):
        '''Generate a uniaxial Elastic Material Steel01
            link for information: https://opensees.berkeley.edu/wiki/index.php/Steel01_Material
            Inputs:
                matName: Name of the material.
                fy: yield strength [MPa].
                E0: initial elastic tangent[MPa].
                b: strain-hardening ratio (ratio between post-yield tangent and initial elastic tangent).
                a1: isotropic hardening parameter, increase of compression yield envelope as proportion of yield strength after a plastic strain of $a2*($Fy/E0). (optional).
                a2: isotropic hardening parameter (see explanation under $a1). (optional).
                a3: isotropic hardening parameter, increase of tension yield envelope as proportion of yield strength after a plastic strain of $a4*($Fy/E0). (optional)
                a4: isotropic hardening parameter (see explanation under $a3). (optional)'''

        self.matName = matName
        self.MinMaxLimit = MinMaxLimit
        self.fy = fy
        self.E0 = E0
        self.b = b
        self.a1 = a1
        self.a2 = a2
        self.a3 = a3
        self.a4 = a4
        
        self.tensionLimitPositive = self.fy
        self.tensionLimitNegative = -self.fy
        
        self.matTag = None
        self.matTagMinMax = None
        
        self.materialDimension = "uniAxialMaterial"
        self.materialType = "Steel01"
        
        self.esh = self.fy/self.E0
        self.eult = 6.75/100

    def ToString(self):
        return self.write_tcl()

    def write_tcl(self):
        if a1 != None and a2 == None and a3 == None and a4 == None:
            return "uniaxialMaterial Steel01 {} {} {} {} {}\n".format(self.matTag, self.fy, self.E0, self.b, self.a1)
        elif a1 != None and a2 != None and a3 == None and a4 == None:
            return "uniaxialMaterial Steel01 {} {} {} {} {} {}\n".format(self.matTag, self.fy, self.E0, self.b, self.a1, self.a2) 
        elif a1 != None and a2 != None and a3 != None and a4 == None:
            return "uniaxialMaterial Steel01 {} {} {} {} {} {} {}\n".format(self.matTag, self.fy, self.E0, self.b, self.a1, self.a2, self.a3) 
        elif a1 == None and a2 == None and a3 == None and a4 == None and self.MinMaxLimit== None:
            return "uniaxialMaterial Steel01 {} {} {} {}\n".format(self.matTag, self.fy, self.E0, self.b) 
        elif self.a1 == None and self.a2 == None and self.a3 == None and self.a4 == None and self.MinMaxLimit== True:            
            a = "uniaxialMaterial Steel01 {} {} {} {}\n".format(self.matTag, self.fy, self.E0, self.b)
            b = "uniaxialMaterial MinMax {} {} -min {} -max {}\n".format(self.matTagMinMax, self.matTag, -self.eult, self.eult)
            return a + b
    def write_py(self):
        if a1 != None and a2 == None and a3 == None and a4 == None:
            return "ops.uniaxialMaterial('Steel01', {}, {}, {}, {}, {})\n".format(self.matTag, self.fy, self.E0, self.b, self.a1)
        elif a1 != None and a2 != None and a3 == None and a4 == None:
            return "ops.uniaxialMaterial('Steel01', {}, {}, {}, {}, {}, {})\n".format(self.matTag, self.fy, self.E0, self.b, self.a1, self.a2) 
        elif a1 != None and a2 != None and a3 != None and a4 == None:
            return "ops.uniaxialMaterial('Steel01', {}, {}, {}, {}, {}, {}, {})\n".format(self.matTag, self.fy, self.E0, self.b, self.a1, self.a2, self.a3) 
        elif a1 != None and a2 != None and a3 != None and a4 != None:
            return "ops.uniaxialMaterial('Steel01', {}, {}, {}, {}, {}, {}, {}, {})\n".format(self.matTag, self.fy, self.E0, self.b, self.a1, self.a2, self.a3,  self.a4) 
        else:
            return "ops.uniaxialMaterial('Steel01', {}, {}, {}, {})\n".format(self.matTag, self.fy, self.E0, self.b)


if checkData:
    uniAxialMaterial = uniAxialMaterialSteel01(name, MinMaxLimit, fy, E0, b, a1, a2, a3, a4)


"""
class uniAxialMaterialSteel01(object):
    def __init__(self, matName, fy, E0, b, a1, a2, a3, a4):
        '''Generate a uniaxial Elastic Material Steel01
            link for information: https://opensees.berkeley.edu/wiki/index.php/Steel01_Material
            Inputs:
                matName: Name of the material.
                fy: yield strength [MPa].
                E0: initial elastic tangent[MPa].
                b: strain-hardening ratio (ratio between post-yield tangent and initial elastic tangent).
                a1: isotropic hardening parameter, increase of compression yield envelope as proportion of yield strength after a plastic strain of $a2*($Fy/E0). (optional).
                a2: isotropic hardening parameter (see explanation under $a1). (optional).
                a3: isotropic hardening parameter, increase of tension yield envelope as proportion of yield strength after a plastic strain of $a4*($Fy/E0). (optional)
                a4: isotropic hardening parameter (see explanation under $a3). (optional)'''

        self.matName = matName
        self.fy = fy
        self.E0 = E0
        self.b = b
        self.a1 = a1
        self.a2 = a2
        self.a3 = a3
        self.a4 = a4

        self.matTag = None

        self.materialDimension = "uniAxialMaterial"
        self.materialType = "Steel01"

    def ToString(self):
        return self.write_tcl()

    def write_tcl(self):
        if a1 != None and a2 == None and a3 == None and a4 == None:
            return "uniaxialMaterial Steel01 {} {} {} {} {}\n".format(self.matTag, self.fy, self.E0, self.b, self.a1)
        elif a1 != None and a2 != None and a3 == None and a4 == None:
            return "uniaxialMaterial Steel01 {} {} {} {} {} {}\n".format(self.matTag, self.fy, self.E0, self.b, self.a1, self.a2) 
        elif a1 != None and a2 != None and a3 != None and a4 == None:
            return "uniaxialMaterial Steel01 {} {} {} {} {} {} {}\n".format(self.matTag, self.fy, self.E0, self.b, self.a1, self.a2, self.a3) 
        elif a1 != None and a2 != None and a3 != None and a4 != None:
            return "uniaxialMaterial Steel01 {} {} {} {} {} {} {} {}\n".format(self.matTag, self.fy, self.E0, self.b, self.a1, self.a2, self.a3,  self.a4) 
        else:
            return "uniaxialMaterial Steel01 {} {} {} {}\n".format(self.matTag, self.fy, self.E0, self.b)
    def write_py(self):
        if a1 != None and a2 == None and a3 == None and a4 == None:
            return "ops.uniaxialMaterial('Steel01', {}, {}, {}, {}, {})\n".format(self.matTag, self.fy, self.E0, self.b, self.a1)
        elif a1 != None and a2 != None and a3 == None and a4 == None:
            return "ops.uniaxialMaterial('Steel01', {}, {}, {}, {}, {}, {})\n".format(self.matTag, self.fy, self.E0, self.b, self.a1, self.a2) 
        elif a1 != None and a2 != None and a3 != None and a4 == None:
            return "ops.uniaxialMaterial('Steel01', {}, {}, {}, {}, {}, {}, {})\n".format(self.matTag, self.fy, self.E0, self.b, self.a1, self.a2, self.a3) 
        elif a1 != None and a2 != None and a3 != None and a4 != None:
            return "ops.uniaxialMaterial('Steel01', {}, {}, {}, {}, {}, {}, {}, {})\n".format(self.matTag, self.fy, self.E0, self.b, self.a1, self.a2, self.a3,  self.a4) 
        else:
            return "ops.uniaxialMaterial('Steel01', {}, {}, {}, {})\n".format(self.matTag, self.fy, self.E0, self.b)
"""
# ---------- end uems01_2 ----------
uemrs = UniaxialElasticMaterialReinforcingSteelAlpaca4d(
    MinMaxLimit=toggle,
    fy=multiplication_11,
    fu=multiplication_9,
    Es=multiplication_12,
    Esh="0.0",
    esh="0.001957",
    eult="0.0675")  # -> out, uniAxialMaterial; inputs MinMaxLimit: Boolean
# ---------- uemrs: Python ----------
"""
Create a uniaxial Elastic Material Reinforcing Steel
-
    Args:
        fy: Yield stress in tension
        fu: Ultimate stress in tension
        Es: Initial elastic tangent
        Esh: Tangent at initial strain hardening
        esh: Strain corresponding to initial strain hardening
        eult: Strain at peak stress
    Returns:
        uniAxialMaterial:
"""

__author__ = "Ing. Domenico Gaudioso"
__contact__ = "DomenicoGaudioso@outlook.it"
__version__ = "2021.09.17"


ghenv.Component.Name = "uniaxial Elastic Material Reinforcing Steel (Alpaca4d)"
ghenv.Component.NickName = 'UEMRS'
ghenv.Component.Message = "uniaxial Reinforcing Steel (Alpaca4d)"

import sys
import Rhino.Geometry as rg
import Grasshopper as gh
import copy


## add alpaca install directory to system path

ghcompfolder = gh.Folders.DefaultAssemblyFolder
if ghcompfolder not in sys.path:
    sys.path.append(ghcompfolder)


   
   
try:
    from Alpaca4d import alpaca4d as alpaca
except:
    msg = "Cannot import Alpaca4d. Is the Alpaca4d folder available in " + ghcompfolder + "?"
    ghenv.Component.AddRuntimeMessage(gh.Kernel.GH_RuntimeMessageLevel.Error, msg)


checkData = True

if not fy:
    checkData = False
    msg = "Input parameter fy failed to collect data"
    ghenv.Component.AddRuntimeMessage(gh.Kernel.GH_RuntimeMessageLevel.Warning, msg)

if not fu:
    checkData = False
    msg = "Input parameter fu failed to collect data"
    ghenv.Component.AddRuntimeMessage(gh.Kernel.GH_RuntimeMessageLevel.Warning, msg)
    
if not Es:
    checkData = False
    msg = "Input parameter Es failed to collect data"
    ghenv.Component.AddRuntimeMessage(gh.Kernel.GH_RuntimeMessageLevel.Warning, msg)
"""
if not Esh:
    checkData = False
    msg = "Input parameter Esh failed to collect data"
    ghenv.Component.AddRuntimeMessage(gh.Kernel.GH_RuntimeMessageLevel.Warning, msg)
"""
if not esh:
    checkData = False
    msg = "Input parameter esh failed to collect data"
    ghenv.Component.AddRuntimeMessage(gh.Kernel.GH_RuntimeMessageLevel.Warning, msg)

if not eult:
    checkData = False
    msg = "Input parameter eult failed to collect data"
    ghenv.Component.AddRuntimeMessage(gh.Kernel.GH_RuntimeMessageLevel.Warning, msg)


class uniAxialMaterialRSteel(object):
    def __init__(self, matName, MinMaxLimit, fy, fu, Es, Esh, esh, eult):
        """Generate a uniaxial Elastic Material Steel01
            link for information: https://opensees.berkeley.edu/wiki/index.php/Steel01_Material
            Inputs:
                matName: Name of the material.
                fy: Yield stress in tension
                fu: Ultimate stress in tension
                Es: Initial elastic tangent
                Esh: Tangent at initial strain hardening
                esh: Strain corresponding to initial strain hardening
                eult: Strain at peak stress
           """

        self.matName = matName
        self.MinMaxLimit = MinMaxLimit
        self.fy = fy
        self.fu = fu
        self.Es = Es
        self.Esh = Esh
        self.esh = esh
        self.eult = eult
        self.tensionLimitPositive = self.fu
        self.tensionLimitNegative = -self.fu
        self.matTag = None
        self.matTagMinMax = None
        
        self.materialDimension = "uniAxialMaterial"
        self.materialType = "Reinforcing Steel"
        

    def ToString(self):
        return self.write_tcl()

    def write_tcl(self):
        a = "uniaxialMaterial ReinforcingSteel {} {} {} {} {} {} {}\n".format(self.matTag, self.fy, self.fu, self.Es, self.Esh, self.esh, self.eult)
        b = "uniaxialMaterial MinMax {} {} -min {} -max {}\n".format(self.matTagMinMax, self.matTag, -self.eult, self.self.eult)
        if MinMaxLimit == True:
            return a + b
        else:
            return a



if checkData:
    uniAxialMaterial = uniAxialMaterialRSteel(name, MinMaxLimit, fy, fu, Es, Esh, esh, eult)


"""
class uniAxialMaterialSteel01(object):
    def __init__(self, matName, fy, E0, b, a1, a2, a3, a4):
        '''Generate a uniaxial Elastic Material Steel01
            link for information: https://opensees.berkeley.edu/wiki/index.php/Steel01_Material
            Inputs:
                matName: Name of the material.
                fy: yield strength [MPa].
                E0: initial elastic tangent[MPa].
                b: strain-hardening ratio (ratio between post-yield tangent and initial elastic tangent).
                a1: isotropic hardening parameter, increase of compression yield envelope as proportion of yield strength after a plastic strain of $a2*($Fy/E0). (optional).
                a2: isotropic hardening parameter (see explanation under $a1). (optional).
                a3: isotropic hardening parameter, increase of tension yield envelope as proportion of yield strength after a plastic strain of $a4*($Fy/E0). (optional)
                a4: isotropic hardening parameter (see explanation under $a3). (optional)'''

        self.matName = matName
        self.fy = fy
        self.E0 = E0
        self.b = b
        self.a1 = a1
        self.a2 = a2
        self.a3 = a3
        self.a4 = a4

        self.matTag = None

        self.materialDimension = "uniAxialMaterial"
        self.materialType = "Steel01"

    def ToString(self):
        return self.write_tcl()

    def write_tcl(self):
        if a1 != None and a2 == None and a3 == None and a4 == None:
            return "uniaxialMaterial Steel01 {} {} {} {} {}\n".format(self.matTag, self.fy, self.E0, self.b, self.a1)
        elif a1 != None and a2 != None and a3 == None and a4 == None:
            return "uniaxialMaterial Steel01 {} {} {} {} {} {}\n".format(self.matTag, self.fy, self.E0, self.b, self.a1, self.a2) 
        elif a1 != None and a2 != None and a3 != None and a4 == None:
            return "uniaxialMaterial Steel01 {} {} {} {} {} {} {}\n".format(self.matTag, self.fy, self.E0, self.b, self.a1, self.a2, self.a3) 
        elif a1 != None and a2 != None and a3 != None and a4 != None:
            return "uniaxialMaterial Steel01 {} {} {} {} {} {} {} {}\n".format(self.matTag, self.fy, self.E0, self.b, self.a1, self.a2, self.a3,  self.a4) 
        else:
            return "uniaxialMaterial Steel01 {} {} {} {}\n".format(self.matTag, self.fy, self.E0, self.b)
    def write_py(self):
        if a1 != None and a2 == None and a3 == None and a4 == None:
            return "ops.uniaxialMaterial('Steel01', {}, {}, {}, {}, {})\n".format(self.matTag, self.fy, self.E0, self.b, self.a1)
        elif a1 != None and a2 != None and a3 == None and a4 == None:
            return "ops.uniaxialMaterial('Steel01', {}, {}, {}, {}, {}, {})\n".format(self.matTag, self.fy, self.E0, self.b, self.a1, self.a2) 
        elif a1 != None and a2 != None and a3 != None and a4 == None:
            return "ops.uniaxialMaterial('Steel01', {}, {}, {}, {}, {}, {}, {})\n".format(self.matTag, self.fy, self.E0, self.b, self.a1, self.a2, self.a3) 
        elif a1 != None and a2 != None and a3 != None and a4 != None:
            return "ops.uniaxialMaterial('Steel01', {}, {}, {}, {}, {}, {}, {}, {})\n".format(self.matTag, self.fy, self.E0, self.b, self.a1, self.a2, self.a3,  self.a4) 
        else:
            return "ops.uniaxialMaterial('Steel01', {}, {}, {}, {})\n".format(self.matTag, self.fy, self.E0, self.b)
"""
# ---------- end uemrs ----------
panel_5 = Panel(uemc01.uniAxialMaterial)
panel_6 = Panel(uems01_2.uniAxialMaterial)
X = Panel("""0.423
0.5
0.577
0.654
0.808
0.934
1.06
1.186
1.174
1.3
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""")
Y = Panel("""0.278
0.338
0.397
0.457
0.448
0.325
0.201
0.078
0.078
0.201
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""")
pt = ConstructPoint(XCoordinate=X, YCoordinate=Y, ZCoordinate=0)
rectangle = Rectangle(Plane=PlaneXY(0, 0, 0), XSize=Domain(-1, 1), YSize=Domain(-2, 2), Radius=0)  # -> Rectangle, Length
mesh_uv = MeshSurface(UCount=5, VCount=5, Overhang=True, Equalize=False)

f = FiberAlpaca4d(material=uemrs.uniAxialMaterial, point=pt, area="0.000314")  # -> out, fiber; inputs point: Point3d
# ---------- f: Python ----------
"""
Create fiber
-
    Args:
        material: material component.
        point: point
        area:  area
            Inputs:
                
                
                
            
    Returns:
        uniAxialMaterial:
"""

ghenv.Component.Name = "fiber (Alpaca4d)"
ghenv.Component.NickName = 'f'
ghenv.Component.Message = "fiber (Alpaca4d)"

import sys
import Rhino.Geometry as rg
import Grasshopper as gh
import copy


## add alpaca install directory to system path

ghcompfolder = gh.Folders.DefaultAssemblyFolder
if ghcompfolder not in sys.path:
    sys.path.append(ghcompfolder)

try:
    from Alpaca4d import alpaca4d as alpaca
except:
    msg = "Cannot import Alpaca4d. Is the Alpaca4d folder available in " + ghcompfolder + "?"
    ghenv.Component.AddRuntimeMessage(gh.Kernel.GH_RuntimeMessageLevel.Error, msg)


checkData = True

if not material:
    checkData = False
    msg = "Input parameter material failed to collect data"
    ghenv.Component.AddRuntimeMessage(gh.Kernel.GH_RuntimeMessageLevel.Warning, msg)

if not point:
    checkData = False
    msg = "Input parameter point failed to collect data"
    ghenv.Component.AddRuntimeMessage(gh.Kernel.GH_RuntimeMessageLevel.Warning, msg)

if not area:
    checkData = False
    msg = "Input parameter area failed to collect data"
    ghenv.Component.AddRuntimeMessage(gh.Kernel.GH_RuntimeMessageLevel.Warning, msg)

import rhinoscriptsyntax as rs
import Rhino.Geometry as rg
import ghpythonlib.components as ghcomp

#a = rg.Mesh.CreateFromSurface(surf4N, rg.MeshingParameters.Default)


class fiber(object):
    def __init__(self, material, point, area):
        """ Generate fiber
            link for information: https://opensees.berkeley.edu/wiki/index.php/Patch_Command
            Inputs:
                matName: Name of the material.
                point:  
                area: 	
        """
        
        self.material = material
        self.point = point
        self.area = area 
        
            
        #self.surf = ghcomp.MeshSurface(polyC, self.U, self.V, True, True)

    def ToString(self):
        return self.write_tcl()

    def write_tcl(self):
        return "fiber {} {} {} {};\n".format(self.point.X, self.point.Y, self.area, self.material.matTag)

if checkData:
    mat = copy.copy(material)
    fiber = fiber(mat, point, area)
# ---------- end f ----------

P = PathAlpaca4d(material=uemc01.uniAxialMaterial, polyC=rectangle.Rectangle, U=Slider(10, range=0..100), V=Slider(50, range=0..100))  # -> out, path, pathSurf; inputs polyC: Curve, U: Int32, V: Int32
# ---------- P: Python ----------
"""
Create path
-
    Args:
        material: material component.
        polyC: polyline with 4 node (only 4 node).
        U:  number of subdivisions (fibers) in the IJ direction.
        V: 	number of subdivisions (fibers) in the JK direction.
            Inputs:
                
                
                
            
    Returns:
        uniAxialMaterial:
"""

ghenv.Component.Name = "path (Alpaca4d)"
ghenv.Component.NickName = 'P'
ghenv.Component.Message = "path (Alpaca4d)"

import sys
import Rhino.Geometry as rg
import Grasshopper as gh
import copy


## add alpaca install directory to system path

ghcompfolder = gh.Folders.DefaultAssemblyFolder
if ghcompfolder not in sys.path:
    sys.path.append(ghcompfolder)

try:
    from Alpaca4d import alpaca4d as alpaca
except:
    msg = "Cannot import Alpaca4d. Is the Alpaca4d folder available in " + ghcompfolder + "?"
    ghenv.Component.AddRuntimeMessage(gh.Kernel.GH_RuntimeMessageLevel.Error, msg)


checkData = True

if not material:
    checkData = False
    msg = "Input parameter material failed to collect data"
    ghenv.Component.AddRuntimeMessage(gh.Kernel.GH_RuntimeMessageLevel.Warning, msg)

if not polyC:
    checkData = False
    msg = "Input parameter polyC failed to collect data"
    ghenv.Component.AddRuntimeMessage(gh.Kernel.GH_RuntimeMessageLevel.Warning, msg)

if not U:
    checkData = False
    msg = "Input parameter U failed to collect data"
    ghenv.Component.AddRuntimeMessage(gh.Kernel.GH_RuntimeMessageLevel.Warning, msg)

if not V:
    checkData = False
    msg = "Input parameter V failed to collect data"
    ghenv.Component.AddRuntimeMessage(gh.Kernel.GH_RuntimeMessageLevel.Warning, msg)

import rhinoscriptsyntax as rs
import Rhino.Geometry as rg
import ghpythonlib.components as ghcomp

#a = rg.Mesh.CreateFromSurface(surf4N, rg.MeshingParameters.Default)


class path(object):
    def __init__(self, material, polyC, U, V):
        """ Generate fiber
            link for information: https://opensees.berkeley.edu/wiki/index.php/Patch_Command
            Inputs:
                matName: Name of the material.
                U:  number of subdivisions (fibers) in the IJ direction.
                V: 	number of subdivisions (fibers) in the JK direction.
        """
        
        self.material = material
        self.polyC = polyC
        self.U = U 
        self.V = V
        
        self.Point = [polyC.Point(i) for i in range(0,4)]
        # Da perfezionare per far avere sempre la stessa direzione
        if self.Point[0].X <= self.Point[1].X:
            print("direction mesh is good")
            
        else:
            print( "non va bene" )
            self.Point.reverse()
            
        self.surf = ghcomp.MeshSurface(polyC, self.U, self.V, True, True)

    def ToString(self):
        return self.write_tcl()

    def write_tcl(self):
        return "patch quad {} {} {} {} {} {} {} {} {} {} {};\n".format(self.material.matTag, self.U, self.V, self.Point[0].X, self.Point[0].Y, self.Point[1].X, self.Point[1].Y, self.Point[2].X, self.Point[2].Y, self.Point[3].X, self.Point[3].Y  )

if checkData:
    mat = copy.copy(material)
    path = path(mat, polyC, U, V)
    pathSurf = path.surf
# ---------- end P ----------
panel_7 = Panel(P.pathSurf)
python = GhPythonScript(fiber=flatten(f.fiber), path=flatten(P.path))  # -> out, FiberSection, FiberMesh, PropSection; inputs fiber: list, path: list, layer: list
# ---------- python: Python ----------
__author__ = "Domen"
__version__ = "2021.08.07"

import rhinoscriptsyntax as rs
import ghpythonlib.components as ghcomp
import Rhino.Geometry as rg
import math as mt

"""
for i, item in enumerate(path):
    print(i, item)
    item.material.matTag = i + 1
"""

class FiberSection(object):
    def __init__(self, fiber, path, layer):
        
        self.fiber = fiber
        self.path = path
        self.layer = layer
        self.secTag = None

        self.mesh = []
        for item in path:
            self.mesh.append(item.surf)
        self.mesh = ghcomp.Kangaroo2Component.CombineClean(self.mesh)
        calculateProp = rg.AreaMassProperties.Compute(self.mesh)
        self.centerSection = calculateProp.Centroid
        self.Area = calculateProp.Area
        
        NuPositive = []
        NuNegative = []
        for item in self.path:
            area = rg.AreaMassProperties.Compute(item.surf).Area
            NuPositive.append( area*item.material.tensionLimitPositive )
            NuNegative.append( area*item.material.tensionLimitNegative )
            
            
        for item in self.layer:
            area = item.Atot*item.nBar
            NuPositive.append( area*item.material.tensionLimitPositive )
            NuNegative.append( area*item.material.tensionLimitNegative )
            
        for item in self.fiber:
            NuPositive.append( item.area*item.material.tensionLimitPositive )
            NuNegative.append( item.area*item.material.tensionLimitNegative )
            
        self.NultNeg = sum(NuNegative)
        self.NultPos = sum(NuPositive)
        # calcolo proprietà della sezione #
        area = 'Area: ' + str(self.Area)  + '\n'
        centroidC = 'Centroid coordinates: ' + "x: {}, y: {}, z: {} ".format(self.centerSection.X, self.centerSection.Y, self.centerSection.Z) + '\n'
        Inertia = calculateProp.CentroidCoordinatesMomentsOfInertia
        InertiaStr = 'Inertia respect the centroid : ' + "Ixx: {}, Iyy: {}, Izz: {} ".format(Inertia.X, Inertia.Y, Inertia.Z) + '\n'
        Nultimo = 'Axial Force ultimate: ' + str([self.NultNeg, self.NultPos])  + '\n'
        self.prop = ''.join([area, centroidC, InertiaStr, Nultimo ])
        

    def ToString(self):
        return self.write_tcl()

    def write_tcl(self):
        section = "section Fiber {} -GJ 10000 {}\n".format(self.secTag, "{;") # -GJ 10000
        # FIBER
        fiberList = ''.join([ i.ToString() for i in self.fiber ])
        # PATH
        pathList = ''.join([ i.ToString() for i in self.path ])
        # LAYER
        layerList = ''.join([ i.ToString() for i in self.layer ])
        
        return section + fiberList + pathList + layerList +"}\n"

    def write_py(self):
        py_text = "ops.section('Elastic',{},{},{},{},{},{},{},{},{})\n".format(self.sectionTag, self.material.E, self.Area, self.Izz, self.Iyy, self.material.G, self.J, self.alphaY, self.alphaZ)
        return py_text


FiberSection = FiberSection(fiber, path, layer)
FiberMesh = FiberSection.mesh
PropSection = FiberSection.prop
print( FiberSection.ToString() )
# ---------- end python ----------
panel_8 = Panel(python.FiberSection)
number_slider = Slider(10000, range=0..10000)
facen = FaceNormals(Mesh=P.pathSurf)  # -> Centers, Normals
number_slider_2 = Slider(96, range=0..100)
number_slider_3 = Slider(30, range=0..100)
pt_2 = Point(Point(0, 0, 0))
number_slider_4 = Slider(10, range=0..10)
item = ListItem(List=facen.Centers, Index=0, Wrap=True)  # -> Item, Item1
panel_9 = Panel(facen.Centers)
neg = Negative(Value=Slider(200, range=0..1000))

number_slider_5 = Slider(50, range=0..100)
neg_2 = Negative(Value=Slider(11437, range=0..100000))
mnm = MNModelAlpaca4d(FiberSection=python.FiberSection, N=neg_2, M1=neg, M2=Slider(0, range=0..100), Pout=facen.Centers)  # -> out, N, M1; inputs centerForce: Point3d, Pout: Point3d
# ---------- mnm: Python ----------
"""
Run an OpenSees Analysis
-
    Args:
        FiberSection:
        direction: 1 for M2 and 2 for M1. Default is 1 
        nPoint: number of Point for make de N-M domain
    Returns:
        N: axial load valor
        M: bending moment valor
"""



import Rhino.RhinoDoc
import Grasshopper as gh
import copy
import rhinoscriptsyntax as rs
import Rhino.Geometry as rg
import os
import time
import sys
import subprocess
import ghpythonlib.treehelpers as th
import math as mt
import ghpythonlib.parallel as ghp



ghenv.Component.Name = "M-N Model (Alpaca4d)"
ghenv.Component.NickName = 'MNM'
ghenv.Component.Message = "M-N Model (Alpaca4d)"

ghcompfolder = gh.Folders.DefaultAssemblyFolder
if ghcompfolder not in sys.path:
    sys.path.append(ghcompfolder)

try:
    from Alpaca4d import alpaca4d as alpaca
except:
    msg = "Cannot import Alpaca4d. Is the Alpaca4d folder available in " + ghcompfolder + "?"
    ghenv.Component.AddRuntimeMessage(gh.Kernel.GH_RuntimeMessageLevel.Error, msg)


checkData = True



if not FiberSection:
    checkData = False
    msg = "Input parameter AlpacaModel failed to collect data"
    ghenv.Component.AddRuntimeMessage(gh.Kernel.GH_RuntimeMessageLevel.Warning, msg)

if centerForce == None:
    centerForce = rg.Point3d(FiberSection.centerSection.X, FiberSection.centerSection.Y, FiberSection.centerSection.Z)

if Pout == None:
    Pout = rg.Point3d(FiberSection.centerSection.X, FiberSection.centerSection.Y, FiberSection.centerSection.Z)
    
class MomentCurvature(object):
    def __init__(self, recorderName, section, cForce, axialLoad, M1, M2, pointOut):
        #^ y
        #|
        #|
        #|------> x
        self.recorderName = recorderName
        self.section = section
        self.cForce = cForce
        self.axialLoad = axialLoad
        self.M1 = M1
        self.M2 = M2
        self.pointOut = pointOut
        self.secTag = 1

    def ToString(self):
        return self.write_tcl()

    def write_tcl(self):
        # Define two nodes at (0,0)
        clean = "wipe\n"
        model = "model BasicBuilder -ndm 3 -ndf 6\n"
        
        materialPath = ''.join([ i.material.write_tcl() for i in self.section.path ])
        materialLayer = ''.join([ i.material.write_tcl() for i in self.section.layer ])
        material = materialPath + materialLayer
        
        section = self.section.ToString()
        node1 = "node {} {} {} {}\n".format(1, self.cForce.X, self.cForce.Y, self.cForce.Z)
        node2 = "node {} {} {} {}\n".format(2, self.cForce.X, self.cForce.Y, self.cForce.Z)
        # Fix all degrees of freedom except axial and bending
        fix1 = "fix {} {} {} {} {} {} {}\n".format(1, 1, 1, 1, 1 ,1, 1) #node tag Fx Fy Fz Mx My Mz
        fix2 = "fix {} {} {} {} {} {} {}\n".format(2, 0, 1, 1, 1, 0, 0) #node tag Fx Fy Fz Mx My Mz
        # Define element
        ele = "element zeroLengthSection {} {} {} {}\n".format( 1, 1, 2, self.secTag) #-orient 1 0 0 1 0 0
        # Define constant axial load
        pattern = 'pattern Plain {} "{}" {}\n'.format( 1, 'Constant', "{;")   
        load = "load {} {} {} {} {} {} {};\n".format(2, self.axialLoad, 0.0, 0.0, 0.0, self.M1, self.M2) +  "}\n" 
        # analysis for constant axial load
        Integrator = "integrator LoadControl {}\n".format( 1)
        System = "system BandGeneral\n" #-piv
        Test = "test NormUnbalance {} {}\n".format( 1e-10, 1000)
        number = "numberer RCM\n"
        constraints = "constraints Plain\n"
        algorithm = "algorithm Newton\n"
        analysis = "analysis Static\n"
        # Do one analysis for constant axial load
        analyze = "analyze {}\n".format(1) 
        lC = "wipe\n"
        # Define reference moment 
        recorder1 = "recorder Element -file {} -ele 1 section fiber {} {} stressStrain\n".format(self.recorderName, self.pointOut.X, self.pointOut.Y )
        #recorder2 = "recorder mpco Data.mpco -E force\n"  # "recorder Element -file {} -ele 1 section fiber 0.03 0.035 stressStrain\n".format(self.recorderName)
        #recorder2 = "recorder Element -file {} -ele 1 section deformation\n".format(recorderName2)
        
        return clean + model + material + section +  node1 + node2 + fix1 + fix2 + ele + pattern + load + Integrator + recorder1 + System + Test + number + constraints + algorithm + analysis + analyze +lC


if checkData:
    FiberSection.secTag = 1
    for i, item in enumerate(FiberSection.path):
        item.material.matTag = i + 1
        #print(item.material.matTag )
    j = i+2
    for i, item in enumerate(FiberSection.layer):
        item.material.matTag = j + i
        #print(j+i)
    w = j+2
    for i, item in enumerate(FiberSection.fiber):
        item.material.matTag = w + i
        

recorderFileName = "DataTensionSection.out"
outputFileName = "ModelTensionSection.txt"
        
            
MC = MomentCurvature(recorderFileName, FiberSection, centerForce, N, M1, M2, Pout) 
script = MC.write_tcl()

FolderPath = rs.DocumentPath()
os.chdir(FolderPath)
    

runFileName = os.path.join(FolderPath,outputFileName)

filepath = os.path.join(FolderPath,recorderFileName)

time_start = time.clock()

with open(outputFileName, 'w') as f:
    for line in MC.write_tcl():
        f.write(line)
    f.close()

time_elapsed = (time.clock() - time_start)
#print("Writing Time {}".format(time_elapsed))

time_start = time.clock()

executable = os.path.join(ghcompfolder,'Alpaca4d\OpenSees-Solvers\opensees.bat')
#executable = os.path.join(ghcompfolder,'C:\OpenSees\bin\opensees.bat')

#process = subprocess.Popen([r'C:\OpenSees\bin\OpenSees', outputFileName], shell = True, stdout=subprocess.PIPE, stderr=subprocess.PIPE)
process = subprocess.Popen([executable, outputFileName], shell = True,  stdout=subprocess.PIPE, stderr=subprocess.PIPE)
stdout, stderr = process.communicate()
print(stderr)
process.kill()

time_elapsed = (time.clock() - time_start)
print("Analyses Time {}".format(time_elapsed))
#filepath = os.path.join(r'C:\OpenSees\bin',recorderFileName)

fileObj = open(filepath, 'r')
words = fileObj.read().splitlines(" ")
#print(fileObj.read())
N = "None"
if len(words) != 0:
    N = float(words[-1].split()[0])
    M1 = float(words[-1].split()[1])
fileObj.close()
# ---------- end mnm ----------

neg_3 = Negative(Value=Slider(150, range=0..1000))
mnm_2 = MNModelAlpaca4d(FiberSection=python.FiberSection, centerForce=pt_2, direction="1", nPoint=Slider(20, range=0..1000))  # -> out, N, M; inputs centerForce: Point3d, nPoint: Int32
# ---------- mnm_2: Python ----------
"""
Run an OpenSees Analysis
-
    Args:
        FiberSection:
        direction: 1 for M2 and 2 for M1. Default is 1 
        nPoint: number of Point for make de N-M domain
    Returns:
        N: axial load valor
        M: bending moment valor
"""



import Rhino.RhinoDoc
import Grasshopper as gh
import copy
import rhinoscriptsyntax as rs
import Rhino.Geometry as rg
import os
import time
import sys
import subprocess
import ghpythonlib.treehelpers as th
import math as mt
import ghpythonlib.parallel as ghp



ghenv.Component.Name = "M-N Model (Alpaca4d)"
ghenv.Component.NickName = 'MNM'
ghenv.Component.Message = "M-N Model (Alpaca4d)"

ghcompfolder = gh.Folders.DefaultAssemblyFolder
if ghcompfolder not in sys.path:
    sys.path.append(ghcompfolder)

try:
    from Alpaca4d import alpaca4d as alpaca
except:
    msg = "Cannot import Alpaca4d. Is the Alpaca4d folder available in " + ghcompfolder + "?"
    ghenv.Component.AddRuntimeMessage(gh.Kernel.GH_RuntimeMessageLevel.Error, msg)


checkData = True



if not FiberSection:
    checkData = False
    msg = "Input parameter AlpacaModel failed to collect data"
    ghenv.Component.AddRuntimeMessage(gh.Kernel.GH_RuntimeMessageLevel.Warning, msg)
if direction == None:
    direction = 1

if centerForce == None:
    centerForce = rg.Point3d(FiberSection.centerSection.X, FiberSection.centerSection.Y, FiberSection.centerSection.Z)
"""
class MomentCurvature(object):
    def __init__(self, recorderName, section, axialLoad, valorMfix, direction, maxPhi, cForce, numIncr=100):
        #^ y
        #|
        #|
        #|------> x
        self.recorderName = recorderName
        self.section = section
        self.axialLoad = axialLoad
        self.valorMfix = valorMfix
        self.direction = direction
        self.maxPhi = maxPhi
        self.cForce = cForce
        self.numIncr= numIncr
        # Compute curvature increment
        #self.dK = self.maxK / self.numIncr
        self.secTag = 1
        

    def ToString(self):
        return self.write_tcl()

    def write_tcl(self):
        # Define two nodes at (0,0)
        clean = "wipe\n"
        model = "model BasicBuilder -ndm 3 -ndf 6\n"
        
        materialFiber = ''.join([ i.material.write_tcl() for i in self.section.fiber ])
        materialPath = ''.join([ i.material.write_tcl() for i in self.section.path ])
        materialLayer = ''.join([ i.material.write_tcl() for i in self.section.layer ])
        material = materialFiber + materialPath + materialLayer
        
        section = self.section.ToString()
        node1 = "node {} {} {} {}\n".format(1, self.cForce.X, self.cForce.Y, self.cForce.Z)
        node2 = "node {} {} {} {}\n".format(2, self.cForce.X, self.cForce.Y, self.cForce.Z)
        # Fix all degrees of freedom except axial and bending
        fix1 = "fix {} {} {} {} {} {} {}\n".format(1, 1, 1, 1, 1 ,1, 1) #node tag Fx Fy Fz Mx My Mz
        fix2 = "fix {} {} {} {} {} {} {}\n".format(2, 0, 1, 1, 1, 0, 0) #node tag Fx Fy Fz Mx My Mz
        # Define element
        ele = "element zeroLengthSection {} {} {} {}\n".format( 1, 1, 2, self.secTag) #-orient 1 0 0 1 0 0
        # Define constant axial load
        pattern = 'pattern Plain {} "{}" {}\n'.format( 1, 'Constant', "{;")   
        load = "load {} {} {} {} {} {} {};\n".format(2, self.axialLoad, 0.0, 0.0, 0.0, 0.0, 0.0) +  "}\n" 
        # analysis for constant axial load
        Integrator = "integrator LoadControl {}\n".format( 0.1)
        System = "system BandGeneral\n" #-piv
        Test = "test NormUnbalance {} {}\n".format( 1e-10, 1000)
        number = "numberer RCM\n"
        constraints = "constraints Plain\n"
        algorithm = "algorithm Newton\n"
        analysis = "analysis Static\n"
        # Do one analysis for constant axial load
        analyze = "analyze {}\n".format(10) 
        lC = "loadConst -time 0.0\n"
        # Define reference moment 
        recorderName1 = self.recorderName + "Force" + ".out"
        recorderName2 = self.recorderName + "Disp" + ".out"
        recorder1 = "recorder Element -file {} -ele 1 section force\n".format(recorderName1)
        #recorder2 = "recorder Element -file {} -ele 1 section deformation\n".format(recorderName2)
        patternM = 'pattern Plain {} "{}" {}\n'.format( 2, 'Linear', "{;")   
        # Use displacement control at node 2 for section analysis
        #IntegratorD = "integrator DisplacementControl {} {} {} {} {} {}\n".format(2,3,0.00035,1,self.dK,self.dK)
        if self.direction == 1 and self.maxPhi >0:
            directionID = 5
            loadM = "load {} {} {} {} {} {} {};\n".format(2, 0.0, 0.0, 0.0, 0.0, self.direction, self.valorMfix) +  "}\n"
            
        elif self.direction == 2 and self.maxPhi >0:
            directionID = 6
            loadM = "load {} {} {} {} {} {} {};\n".format(2, 0.0, 0.0, 0.0, 0.0, self.valorMfix, self.direction) +  "}\n" 
            
        elif self.direction == 1 and self.maxPhi <0:
            directionID = 5
            loadM = "load {} {} {} {} {} {} {};\n".format(2, 0.0, 0.0, 0.0, 0.0, -self.direction, self.valorMfix) +  "}\n" 
            
        elif self.direction == 2 and self.maxPhi <0:
            directionID = 6
            loadM = "load {} {} {} {} {} {} {};\n".format(2, 0.0, 0.0, 0.0, 0.0, self.valorMfix, -self.direction) +  "}\n" 
            
        IntegratorD = "integrator DisplacementControl {} {} {} {}\n".format(2,directionID,self.maxPhi/self.numIncr, 100) #node dof incr numIter
        #IntegratorD = 'integrator ' + self.Integrator.ToString() + "\n"
        analyze2 = "analyze {}\n".format(self.numIncr) + "\n" + "wipe"+ "\n"

        analyze2 = "set ok [analyze {}]\n".format(self.numIncr) #+ "\n" + "wipe"+ "\n"
        A = "set IDctrlNode 2\n" 
        B = "set IDctrlDOF 6\n"
        C = "set Dmax {}\n".format(self.maxPhi)
        D = "set Dincr {}\n".format(self.maxPhi/self.numIncr)
        E = "set TolStatic {}\n".format(1.e-9)
        F = "set testTypeStatic EnergyIncr \n"
        G = "set maxNumIterStatic {}\n".format(11)
        H = "set algorithmTypeStatic Newton\n"
        #source = "wipe\n"
        source = "source C:/Users/Domen/Desktop/Alpaca MC/aaa.txt\n"

        #return clean + model + material + section +  node1 + node2 + fix1 + fix2 + ele + pattern + load + Integrator + System + Test + number + constraints + algorithm + analysis + analyze +lC + recorder1 + patternM + loadM + IntegratorD + analyze2 + A + B + C + D + E + F + G + H + source
        return clean + model + material + section +  node1 + node2 + fix1 + fix2 + ele + pattern + load + Integrator + System + Test + number + constraints + algorithm + analysis + analyze +lC + recorder1 + patternM + loadM + IntegratorD + analyze2


    def write_py(self):
        # Define two nodes at (0,0)


        return node1 + node2 + fix1 + fix2 + ele  + timeSeries + pattern + load + Integrator + System + test + number + constraints + algorithm + analysis + analyze + timeSeriesM + patternM + loadM + IntegratorD + analyze2
"""
class MomentCurvature(object):
    def __init__(self, recorderName, section, axialLoad, alpha, maxPhi, numIncr=100):
        #^ y
        #|
        #|
        #|------> x
        self.recorderName = recorderName
        self.section = section
        self.axialLoad = axialLoad
        self.alpha = mt.radians(alpha)
        self.maxPhi = maxPhi
        self.numIncr= numIncr
        # Compute curvature increment
        #self.dK = self.maxK / self.numIncr
        self.secTag = 1
        

    def ToString(self):
        return self.write_tcl()

    def write_tcl(self):
        # Define two nodes at (0,0)
        clean = "wipe\n"
        model = "model BasicBuilder -ndm 3 -ndf 6\n"
        
        materialFiber = ''.join([ i.material.write_tcl() for i in self.section.fiber ])
        materialPath = ''.join([ i.material.write_tcl() for i in self.section.path ])
        materialLayer = ''.join([ i.material.write_tcl() for i in self.section.layer ])
        material = materialFiber + materialPath + materialLayer
        
        section = self.section.ToString()
        node1 = "node {} {} {} {}\n".format(1, 0.0, 0.0, 0.0)
        node2 = "node {} {} {} {}\n".format(2, 0.0, 0.0, 0.0)
        # Fix all degrees of freedom except axial and bending
        fix1 = "fix {} {} {} {} {} {} {}\n".format(1, 1, 1, 1, 1 ,1, 1) #node tag Fx Fy Fz Mx My Mz
        fix2 = "fix {} {} {} {} {} {} {}\n".format(2, 0, 1, 1, 1, 0, 0) #node tag Fx Fy Fz Mx My Mz
        # Define element
        ele = "element zeroLengthSection {} {} {} {} -orient 1 0 0 0 {} {}\n".format( 1, 1, 2, self.secTag, mt.cos(self.alpha), mt.sin(self.alpha)) #-orient 1 0 0 0 $cos $sin
        # Define constant axial load
        pattern = 'pattern Plain {} "{}" {}\n'.format( 1, 'Constant', "{;")   
        load = "load {} {} {} {} {} {} {};\n".format(2, self.axialLoad, 0.0, 0.0, 0.0, 0.0, 0.0) +  "}\n" 
        # analysis for constant axial load
        Integrator = "integrator LoadControl {}\n".format( 0.1)
        System = "system BandGeneral\n" #-piv
        Test = "test NormUnbalance {} {}\n".format( 1e-10, 1000)
        number = "numberer RCM\n"
        constraints = "constraints Plain\n"
        algorithm = "algorithm Newton\n"
        analysis = "analysis Static\n"
        # Do one analysis for constant axial load
        analyze = "analyze {}\n".format(10) 
        lC = "loadConst -time 0.0\n"
        # Define reference moment 
        recorderName1 = self.recorderName + "Force" + ".out"
        recorderName2 = self.recorderName + "Disp" + ".out"
        recorder1 = "recorder Element -file {} -ele 1 section force\n".format(recorderName1)
        #recorder2 = "recorder Element -file {} -ele 1 section deformation\n".format(recorderName2)
        patternM = 'pattern Plain {} "{}" {}\n'.format( 2, 'Linear', "{;")   
        # Use displacement control at node 2 for section analysis
        loadM = "load {} {} {} {} {} {} {};\n".format(2, 0.0, 0.0, 0.0, 0.0, 1.0, 0.0) +  "}\n" 
        IntegratorD = "integrator DisplacementControl {} {} {}\n".format(2, 5, self.maxPhi/self.numIncr)
        #IntegratorD = 'integrator ' + self.Integrator.ToString() + "\n"
        analyze2 = "analyze {}\n".format(self.numIncr) + "\n" + "wipe"+ "\n"

        return clean + model + material + section +  node1 + node2 + fix1 + fix2 + ele + pattern + load + Integrator + System + Test + number + constraints + algorithm + analysis + analyze +lC + recorder1 + patternM + loadM + IntegratorD + analyze2


def RunMCpositive(Pi): 
    if Pi > 0.0:
        recorderFileName = "MKsectionP{}positiveMpositive".format(int(mt.fabs(Pi)))
        outputFileName = "OSSModel{}positiveMpositive".format(int(mt.fabs(Pi)))
    elif Pi < 0.0:
        recorderFileName = "MKsectionP{}negativeMpositive".format(int(mt.fabs(Pi)))
        outputFileName = "OSSModel{}negativeMpositive".format(int(mt.fabs(Pi)))
        
    if direction == 1:
        alpha = 0.0
    else:
        alpha = 90.0
            
    MC = MomentCurvature(recorderFileName,FiberSection, float(Pi), alpha, 2.0, 1000) #mu*FiberSection.Ky
    script = MC.write_tcl()
    
    FolderPath = rs.DocumentPath()
    os.chdir(FolderPath)
        
    recorderFileName1 = recorderFileName + "Force" + ".out"
    recorderFileName2 = recorderFileName + "Disp" + ".out"
    
    runFileName = os.path.join(FolderPath,outputFileName)
    filepath1 = os.path.join(FolderPath,recorderFileName1)
    #filepath2 = os.path.join(FolderPath,recorderFileName2)
    """
    if os.path.exists(runFileName):
      os.remove(runFileName)
      os.remove(filepath1)
      os.remove(filepath1)
    else:
      print("The file does not exist")
    """
    time_start = time.clock()
    
    with open(outputFileName, 'w') as f:
        for line in MC.write_tcl():
            f.write(line)
        f.close()
    
    time_elapsed = (time.clock() - time_start)
    #print("Writing Time {}".format(time_elapsed))
    
    time_start = time.clock()
    
    executable = os.path.join(ghcompfolder,'Alpaca4d\OpenSees-Solvers\opensees.bat')
    #executable = os.path.join(ghcompfolder,'C:\OpenSees\bin\opensees.bat')
    
    #process = subprocess.Popen([r'C:\OpenSees\bin\OpenSees', outputFileName], shell = True, stdout=subprocess.PIPE, stderr=subprocess.PIPE)
    process = subprocess.Popen([executable, outputFileName], shell = True,  stdout=subprocess.PIPE, stderr=subprocess.PIPE)
    stdout, stderr = process.communicate()
    #print(stdout, stderr)
    process.kill()
    os.remove(runFileName)
    time_elapsed = (time.clock() - time_start)
    #print("Analyses Time {}".format(time_elapsed))
    #filepath = os.path.join(r'C:\OpenSees\bin',recorderFileName)
    fileObj = open(filepath1, 'r')
    words = fileObj.read().splitlines(" ")
    #print(fileObj.read())
    N = "None"
    if len(words) != 0:
        N = float(words[-1].split()[0])
        M1 = float(words[-1].split()[1])
        M2 = float(words[-1].split()[2])
    fileObj.close()

    os.remove(filepath1)
    """
    fileObj = open(filepath2, 'r')
    words = fileObj.read().splitlines(" ")
    #print(fileObj.read())

    k1 = [ float(i.split()[1]) for i in words]
    k2 = [ float(i.split()[2]) for i in words]
    k3 = [ float(i.split()[3]) for i in words]
    fileObj.close()
    """
    #os.remove(filepath2)
    if N != "None" :
        return [N, M1, M2]


def RunMCnegative(Pi): 

    if Pi > 0.0:
        recorderFileName = "MKsectionP{}positiveMnegative".format(int(mt.fabs(Pi)))
        outputFileName = "OSSModel{}positiveMnegative".format(int(mt.fabs(Pi)))
    elif Pi < 0.0:
        recorderFileName = "MKsectionP{}negativeMnegative".format(int(mt.fabs(Pi)))
        outputFileName = "OSSModel{}negativeMnegative".format(int(mt.fabs(Pi)))
        
    if direction == 1:
        alpha = 180.00
    else:
        alpha = 270.00
            
    MC = MomentCurvature(recorderFileName,FiberSection, float(Pi), alpha, 2.0, 1000)
    script = MC.write_tcl()
    
    FolderPath = rs.DocumentPath()
    os.chdir(FolderPath)
        
    recorderFileName1 = recorderFileName + "Force" + ".out"
    recorderFileName2 = recorderFileName + "Disp" + ".out"
    
    runFileName = os.path.join(FolderPath,outputFileName)
    filepath1 = os.path.join(FolderPath,recorderFileName1)
    #filepath2 = os.path.join(FolderPath,recorderFileName2)
    """
    if os.path.exists(runFileName):
      os.remove(runFileName)
      os.remove(filepath1)
      os.remove(filepath1)
    else:
      print("The file does not exist")
      """
    time_start = time.clock()
    
    with open(outputFileName, 'w') as f:
        for line in MC.write_tcl():
            f.write(line)
        f.close()
    
    time_elapsed = (time.clock() - time_start)
    #print("Writing Time {}".format(time_elapsed))
    
    time_start = time.clock()
    
    executable = os.path.join(ghcompfolder,'Alpaca4d\OpenSees-Solvers\opensees.bat')
    #executable = os.path.join(ghcompfolder,'C:\OpenSees\bin\opensees.bat')
    
    #process = subprocess.Popen([r'C:\OpenSees\bin\OpenSees', outputFileName], shell = True, stdout=subprocess.PIPE, stderr=subprocess.PIPE)
    process = subprocess.Popen([executable, outputFileName], shell = True,  stdout=subprocess.PIPE, stderr=subprocess.PIPE)
    stdout, stderr = process.communicate()
    #print(stdout, stderr)
    process.kill()
    os.remove(runFileName)
    time_elapsed = (time.clock() - time_start)
    #print("Analyses Time {}".format(time_elapsed))
    #filepath = os.path.join(r'C:\OpenSees\bin',recorderFileName)
    fileObj = open(filepath1, 'r')
    words = fileObj.read().splitlines(" ")
    #print(fileObj.read())
    N = "None"
    if len(words) != 0:
        N = float(words[-1].split()[0])
        M1 = float(words[-1].split()[1])
        M2 = float(words[-1].split()[2])
    fileObj.close()

    os.remove(filepath1)
    """
    fileObj = open(filepath2, 'r')
    words = fileObj.read().splitlines(" ")
    #print(fileObj.read())

    k1 = [ float(i.split()[1]) for i in words]
    k2 = [ float(i.split()[2]) for i in words]
    k3 = [ float(i.split()[3]) for i in words]
    fileObj.close()
    """
    #os.remove(filepath2)
    if N != "None" :
        return [N, M1, M2]
        
        

        
if checkData:
    FiberSection.secTag = 1
    for i, item in enumerate(FiberSection.path):
        item.material.matTag = 2*(i+1)
        item.material.matTagMinMax = 2*i+1
        #print(item.material.matTag )
    j = i+2
    for i, item in enumerate(FiberSection.layer):
        j = j + i 
        item.material.matTag = 2*(j+1)
        item.material.matTagMinMax = 2*j+1
        #print(j+i)
    w = j+2
    for i, item in enumerate(FiberSection.fiber):
        w = w + i 
        item.material.matTag = 2*(w+1)
        item.material.matTagMinMax = 2*w+1
        
#A = ghp.run(RunNEps,[-1.0, 1.0], True)


def linspace(start, stop, len):
    step = (mt.fabs(start)+stop)/(len-1)
    return [start + step*interval for interval in range(len)]
    
print(FiberSection.NultNeg+0.1*FiberSection.NultNeg,FiberSection.NultPos)


#n1 = int(mt.fabs(min(A)/stepValorPositive))
#n2 = int(mt.fabs(max(A)/stepValorNegative))

#listP = linspace(min(A), -5.0, n1) + linspace(5, max(A)-10.0, n2)

if nPoint == None:
    nPoint = 10
    
listP = linspace(FiberSection.NultNeg,FiberSection.NultPos, nPoint)


B = ghp.run(RunMCpositive, listP,False)
C = ghp.run(RunMCnegative, listP,False)

#print(D[7])
#RunM1Cpositive(Pi): 


Nupos, Nuneg = [], []
M1uP, M2uP = [], []
M1uN, M2uN = [], []

B =filter(None, B) #elimino il None
C =filter(None, C) 

for item in B:
    Nupos.append(item[0])
    M1uP.append( item[1])
    M2uP.append( item[2])
    #M3uP.append( item[3])
    
for item in C:
    Nuneg.append(item[0])
    M1uN.append( item[1])
    M2uN.append( item[2])

M1 = M1uN + M1uP[::-1] + M1uN[0:1]
M2 = M2uN + M2uP[::-1] + M2uN[0:1]
N = Nuneg + Nupos[::-1] + Nuneg[0:1]

if direction == 1:
    M = M2
else:
    M = M1
# ---------- end mnm_2 ----------
dm1m2 = DomainM1M2Alpaca4d(FiberSection=python.FiberSection, nPoint=Slider(36, range=0..100))  # -> out, N, M1, M2; inputs nPoint: Int32
# ---------- dm1m2: Python ----------
"""
Run an OpenSees Analysis
-
    Args:
        FiberSection:
        direction: 1 for M2 and 2 for M1. Default is 1 
        nPoint: number of Point for make de N-M domain
    Returns:
        N: axial load valor
        M: bending moment valor
"""



import Rhino.RhinoDoc
import Grasshopper as gh
import copy
import rhinoscriptsyntax as rs
import Rhino.Geometry as rg
import os
import time
import sys
import subprocess
import ghpythonlib.treehelpers as th
import math as mt
import ghpythonlib.parallel as ghp



ghenv.Component.Name = "Domain M1 M2 (Alpaca4d)"
ghenv.Component.NickName = 'DM1M2'
ghenv.Component.Message = "Domain M1 M2 (Alpaca4d)"

ghcompfolder = gh.Folders.DefaultAssemblyFolder
if ghcompfolder not in sys.path:
    sys.path.append(ghcompfolder)

try:
    from Alpaca4d import alpaca4d as alpaca
except:
    msg = "Cannot import Alpaca4d. Is the Alpaca4d folder available in " + ghcompfolder + "?"
    ghenv.Component.AddRuntimeMessage(gh.Kernel.GH_RuntimeMessageLevel.Error, msg)


checkData = True



if not FiberSection:
    checkData = False
    msg = "Input parameter AlpacaModel failed to collect data"
    ghenv.Component.AddRuntimeMessage(gh.Kernel.GH_RuntimeMessageLevel.Warning, msg)


"""
class MomentCurvature(object):
    def __init__(self, recorderName, section, axialLoad, valorMfix, direction, maxPhi, cForce, numIncr=100):
        #^ y
        #|
        #|
        #|------> x
        self.recorderName = recorderName
        self.section = section
        self.axialLoad = axialLoad
        self.valorMfix = valorMfix
        self.direction = direction
        self.maxPhi = maxPhi
        self.cForce = cForce
        self.numIncr= numIncr
        # Compute curvature increment
        #self.dK = self.maxK / self.numIncr
        self.secTag = 1
        

    def ToString(self):
        return self.write_tcl()

    def write_tcl(self):
        # Define two nodes at (0,0)
        clean = "wipe\n"
        model = "model BasicBuilder -ndm 3 -ndf 6\n"
        
        materialFiber = ''.join([ i.material.write_tcl() for i in self.section.fiber ])
        materialPath = ''.join([ i.material.write_tcl() for i in self.section.path ])
        materialLayer = ''.join([ i.material.write_tcl() for i in self.section.layer ])
        material = materialFiber + materialPath + materialLayer
        
        section = self.section.ToString()
        node1 = "node {} {} {} {}\n".format(1, self.cForce.X, self.cForce.Y, self.cForce.Z)
        node2 = "node {} {} {} {}\n".format(2, self.cForce.X, self.cForce.Y, self.cForce.Z)
        # Fix all degrees of freedom except axial and bending
        fix1 = "fix {} {} {} {} {} {} {}\n".format(1, 1, 1, 1, 1 ,1, 1) #node tag Fx Fy Fz Mx My Mz
        fix2 = "fix {} {} {} {} {} {} {}\n".format(2, 0, 1, 1, 1, 0, 0) #node tag Fx Fy Fz Mx My Mz
        # Define element
        ele = "element zeroLengthSection {} {} {} {}\n".format( 1, 1, 2, self.secTag) #-orient 1 0 0 1 0 0
        # Define constant axial load
        pattern = 'pattern Plain {} "{}" {}\n'.format( 1, 'Constant', "{;")   
        load = "load {} {} {} {} {} {} {};\n".format(2, self.axialLoad, 0.0, 0.0, 0.0, 0.0, 0.0) +  "}\n" 
        # analysis for constant axial load
        Integrator = "integrator LoadControl {}\n".format( 0.1)
        System = "system BandGeneral\n" #-piv
        Test = "test NormUnbalance {} {}\n".format( 1e-10, 1000)
        number = "numberer RCM\n"
        constraints = "constraints Plain\n"
        algorithm = "algorithm Newton\n"
        analysis = "analysis Static\n"
        # Do one analysis for constant axial load
        analyze = "analyze {}\n".format(10) 
        lC = "loadConst -time 0.0\n"
        # Define reference moment 
        recorderName1 = self.recorderName + "Force" + ".out"
        recorderName2 = self.recorderName + "Disp" + ".out"
        recorder1 = "recorder Element -file {} -ele 1 section force\n".format(recorderName1)
        #recorder2 = "recorder Element -file {} -ele 1 section deformation\n".format(recorderName2)
        patternM = 'pattern Plain {} "{}" {}\n'.format( 2, 'Linear', "{;")   
        # Use displacement control at node 2 for section analysis
        #IntegratorD = "integrator DisplacementControl {} {} {} {} {} {}\n".format(2,3,0.00035,1,self.dK,self.dK)
        if self.direction == 1 and self.maxPhi >0:
            directionID = 5
            loadM = "load {} {} {} {} {} {} {};\n".format(2, 0.0, 0.0, 0.0, 0.0, self.direction, self.valorMfix) +  "}\n"
            
        elif self.direction == 2 and self.maxPhi >0:
            directionID = 6
            loadM = "load {} {} {} {} {} {} {};\n".format(2, 0.0, 0.0, 0.0, 0.0, self.valorMfix, self.direction) +  "}\n" 
            
        elif self.direction == 1 and self.maxPhi <0:
            directionID = 5
            loadM = "load {} {} {} {} {} {} {};\n".format(2, 0.0, 0.0, 0.0, 0.0, -self.direction, self.valorMfix) +  "}\n" 
            
        elif self.direction == 2 and self.maxPhi <0:
            directionID = 6
            loadM = "load {} {} {} {} {} {} {};\n".format(2, 0.0, 0.0, 0.0, 0.0, self.valorMfix, -self.direction) +  "}\n" 
            
        IntegratorD = "integrator DisplacementControl {} {} {} {}\n".format(2,directionID,self.maxPhi/self.numIncr, 100) #node dof incr numIter
        #IntegratorD = 'integrator ' + self.Integrator.ToString() + "\n"
        analyze2 = "analyze {}\n".format(self.numIncr) + "\n" + "wipe"+ "\n"

        analyze2 = "set ok [analyze {}]\n".format(self.numIncr) #+ "\n" + "wipe"+ "\n"
        A = "set IDctrlNode 2\n" 
        B = "set IDctrlDOF 6\n"
        C = "set Dmax {}\n".format(self.maxPhi)
        D = "set Dincr {}\n".format(self.maxPhi/self.numIncr)
        E = "set TolStatic {}\n".format(1.e-9)
        F = "set testTypeStatic EnergyIncr \n"
        G = "set maxNumIterStatic {}\n".format(11)
        H = "set algorithmTypeStatic Newton\n"
        #source = "wipe\n"
        source = "source C:/Users/Domen/Desktop/Alpaca MC/aaa.txt\n"

        #return clean + model + material + section +  node1 + node2 + fix1 + fix2 + ele + pattern + load + Integrator + System + Test + number + constraints + algorithm + analysis + analyze +lC + recorder1 + patternM + loadM + IntegratorD + analyze2 + A + B + C + D + E + F + G + H + source
        return clean + model + material + section +  node1 + node2 + fix1 + fix2 + ele + pattern + load + Integrator + System + Test + number + constraints + algorithm + analysis + analyze +lC + recorder1 + patternM + loadM + IntegratorD + analyze2


    def write_py(self):
        # Define two nodes at (0,0)


        return node1 + node2 + fix1 + fix2 + ele  + timeSeries + pattern + load + Integrator + System + test + number + constraints + algorithm + analysis + analyze + timeSeriesM + patternM + loadM + IntegratorD + analyze2
"""
def linspace(start, stop, len):
    step = (mt.fabs(start)+stop)/(len-1)
    return [start + step*interval for interval in range(len)]
    
class MomentCurvature(object):
    def __init__(self, recorderName, section, axialLoad, alpha, maxPhi, numIncr=100):
        #^ y
        #|
        #|
        #|------> x
        self.recorderName = recorderName
        self.section = section
        self.axialLoad = axialLoad
        self.alpha = mt.radians(alpha)
        self.maxPhi = maxPhi
        self.numIncr= numIncr
        # Compute curvature increment
        #self.dK = self.maxK / self.numIncr
        self.secTag = 1
        

    def ToString(self):
        return self.write_tcl()

    def write_tcl(self):
        # Define two nodes at (0,0)
        clean = "wipe\n"
        model = "model BasicBuilder -ndm 3 -ndf 6\n"
        
        materialFiber = ''.join([ i.material.write_tcl() for i in self.section.fiber ])
        materialPath = ''.join([ i.material.write_tcl() for i in self.section.path ])
        materialLayer = ''.join([ i.material.write_tcl() for i in self.section.layer ])
        material = materialFiber + materialPath + materialLayer
        
        section = self.section.ToString()
        node1 = "node {} {} {} {}\n".format(1, self.section.centerSection.X, self.section.centerSection.Y, self.section.centerSection.Z)
        node2 = "node {} {} {} {}\n".format(2, self.section.centerSection.X, self.section.centerSection.Y, self.section.centerSection.Z)
        # Fix all degrees of freedom except axial and bending
        fix1 = "fix {} {} {} {} {} {} {}\n".format(1, 1, 1, 1, 1 ,1, 1) #node tag Fx Fy Fz Mx My Mz
        fix2 = "fix {} {} {} {} {} {} {}\n".format(2, 0, 1, 1, 1, 0, 0) #node tag Fx Fy Fz Mx My Mz
        # Define element
        ele = "element zeroLengthSection {} {} {} {} -orient 1 0 0 0 {} {}\n".format( 1, 1, 2, self.secTag, mt.cos(self.alpha), mt.sin(self.alpha)) #-orient 1 0 0 0 $cos $sin
        # Define constant axial load
        pattern = 'pattern Plain {} "{}" {}\n'.format( 1, 'Constant', "{;")   
        load = "load {} {} {} {} {} {} {};\n".format(2, self.axialLoad, 0.0, 0.0, 0.0, 0.0, 0.0) +  "}\n" 
        # analysis for constant axial load
        Integrator = "integrator LoadControl {}\n".format( 0.1)
        System = "system BandGeneral\n" #-piv
        Test = "test NormUnbalance {} {}\n".format( 1e-10, 1000)
        number = "numberer RCM\n"
        constraints = "constraints Plain\n"
        algorithm = "algorithm Newton\n"
        analysis = "analysis Static\n"
        # Do one analysis for constant axial load
        analyze = "analyze {}\n".format(10) 
        lC = "loadConst -time 0.0\n"
        # Define reference moment 
        recorderName1 = self.recorderName + "Force" + ".out"
        recorderName2 = self.recorderName + "Disp" + ".out"
        recorder1 = "recorder Element -file {} -ele 1 section force\n".format(recorderName1)
        #recorder2 = "recorder Element -file {} -ele 1 section deformation\n".format(recorderName2)
        patternM = 'pattern Plain {} "{}" {}\n'.format( 2, 'Linear', "{;")   
        # Use displacement control at node 2 for section analysis
        loadM = "load {} {} {} {} {} {} {};\n".format(2, 0.0, 0.0, 0.0, 0.0, 1.0, 0.0) +  "}\n" 
        IntegratorD = "integrator DisplacementControl {} {} {}\n".format(2, 5, self.maxPhi/self.numIncr)
        #IntegratorD = 'integrator ' + self.Integrator.ToString() + "\n"
        analyze2 = "analyze {}\n".format(self.numIncr) + "\n" + "wipe"+ "\n"

        return clean + model + material + section +  node1 + node2 + fix1 + fix2 + ele + pattern + load + Integrator + System + Test + number + constraints + algorithm + analysis + analyze +lC + recorder1 + patternM + loadM + IntegratorD + analyze2


def RunMCpositive(Pi): 
    if Pi > 0.0:
        recorderFileName = "MKsectionP{}positiveMpositive".format(int(mt.fabs(Pi)))
        outputFileName = "OSSModel{}positiveMpositive".format(int(mt.fabs(Pi)))
    elif Pi < 0.0:
        recorderFileName = "MKsectionP{}negativeMpositive".format(int(mt.fabs(Pi)))
        outputFileName = "OSSModel{}negativeMpositive".format(int(mt.fabs(Pi)))
    
    if nPoint == None:
        alpha = linspace(0,360, 36)
    else :
        alpha = linspace(0,360, nPoint)
   
        
    listN = []
    listM1 = []
    listM2 = []
    for alphai in alpha:
        MC = MomentCurvature(recorderFileName,FiberSection, float(Pi), alphai, 2.0, 1000) #mu*FiberSection.Ky
        script = MC.write_tcl()
    
        FolderPath = rs.DocumentPath()
        os.chdir(FolderPath)
        
        recorderFileName1 = recorderFileName + "Force" + ".out"
        recorderFileName2 = recorderFileName + "Disp" + ".out"
    
        runFileName = os.path.join(FolderPath,outputFileName)
        filepath1 = os.path.join(FolderPath,recorderFileName1)
        #filepath2 = os.path.join(FolderPath,recorderFileName2)
        time_start = time.clock()
    
        with open(outputFileName, 'w') as f:
            for line in MC.write_tcl():
                f.write(line)
            f.close()
    
        time_elapsed = (time.clock() - time_start)
        #print("Writing Time {}".format(time_elapsed))
        
        time_start = time.clock()
        
        executable = os.path.join(ghcompfolder,'Alpaca4d\OpenSees-Solvers\opensees.bat')
        #executable = os.path.join(ghcompfolder,'C:\OpenSees\bin\opensees.bat')
        
        #process = subprocess.Popen([r'C:\OpenSees\bin\OpenSees', outputFileName], shell = True, stdout=subprocess.PIPE, stderr=subprocess.PIPE)
        process = subprocess.Popen([executable, outputFileName], shell = True,  stdout=subprocess.PIPE, stderr=subprocess.PIPE)
        stdout, stderr = process.communicate()
        #print(stdout, stderr)
        process.kill()
        os.remove(runFileName)
        time_elapsed = (time.clock() - time_start)
        #print("Analyses Time {}".format(time_elapsed))
        #filepath = os.path.join(r'C:\OpenSees\bin',recorderFileName)
        fileObj = open(filepath1, 'r')
        words = fileObj.read().splitlines(" ")
        #print(fileObj.read())
        N = "None"
        if len(words) != 0:
            N = float(words[-1].split()[0])
            M1 = float(words[-1].split()[1])
            M2 = float(words[-1].split()[2])
            
            listN.append(N)
            listM1.append(M1)
            listM2.append(M2)
        fileObj.close()

        os.remove(filepath1)
    """
    fileObj = open(filepath2, 'r')
    words = fileObj.read().splitlines(" ")
    #print(fileObj.read())

    k1 = [ float(i.split()[1]) for i in words]
    k2 = [ float(i.split()[2]) for i in words]
    k3 = [ float(i.split()[3]) for i in words]
    fileObj.close()
    """
        #os.remove(filepath2)
    if N != "None" :
        return [listN, listM1, listM2]


        
        

        
if checkData:
    FiberSection.secTag = 1
    for i, item in enumerate(FiberSection.path):
        item.material.matTag = 2*(i+1)
        item.material.matTagMinMax = 2*i+1
        #print(item.material.matTag )
    j = i+2
    for i, item in enumerate(FiberSection.layer):
        j = j + i 
        item.material.matTag = 2*(j+1)
        item.material.matTagMinMax = 2*j+1
        #print(j+i)
    w = j+2
    for i, item in enumerate(FiberSection.fiber):
        w = w + i 
        item.material.matTag = 2*(w+1)
        item.material.matTagMinMax = 2*w+1
        
#A = ghp.run(RunNEps,[-1.0, 1.0], True)



    
print(FiberSection.NultNeg+0.1*FiberSection.NultNeg,FiberSection.NultPos)


#n1 = int(mt.fabs(min(A)/stepValorPositive))
#n2 = int(mt.fabs(max(A)/stepValorNegative))

#listP = linspace(min(A), -5.0, n1) + linspace(5, max(A)-10.0, n2)


if axialLoad == None:
    axialLoad = 0.1
B = ghp.run(RunMCpositive, [axialLoad],False)
B =filter(None, B)
#C = ghp.run(RunMCnegative, listP,False)

#print(B[1])
#RunM1Cpositive(Pi): 

N, M1, M2 = [], [], []

for item in B:
    #item =filter(None, item) #elimino il None
    N.append(item[0])
    M1.append(item[1])
    M2.append(item[2])


N, M1, M2 = th.list_to_tree(N), th.list_to_tree(M1), th.list_to_tree(M2)



"""
for item in B:
    Nupos.append(item[0])
    M1uP.append( item[1])
    M2uP.append( item[2])
    #M3uP.append( item[3])
    
for item in C:
    Nuneg.append(item[0])
    M1uN.append( item[1])
    M2uN.append( item[2])

M1 = M1uN + M1uP[::-1] + M1uN[0:1]
M2 = M2uN + M2uP[::-1] + M2uN[0:1]
N = Nuneg + Nupos[::-1] + Nuneg[0:1]

if direction == 1:
    M = M2
else:
    M = M1
"""
# ---------- end dm1m2 ----------
_3dd = _3DDomainAlpaca4d(FiberSection=python.FiberSection, nPoint=Slider(10, range=0..10))  # -> out, N, M1, M2; inputs nPoint: Int32
# ---------- _3dd: Python ----------
"""
Run an OpenSees Analysis
-
    Args:
        FiberSection:
        direction: 1 for M2 and 2 for M1. Default is 1 
        nPoint: number of Point for make de N-M domain
    Returns:
        N: axial load valor
        M: bending moment valor
"""



import Rhino.RhinoDoc
import Grasshopper as gh
import copy
import rhinoscriptsyntax as rs
import Rhino.Geometry as rg
import os
import time
import sys
import subprocess
import ghpythonlib.treehelpers as th
import math as mt
import ghpythonlib.parallel as ghp


__author__ = "Ing. Domenico Gaudioso"
__contact__ = "DomenicoGaudioso@outlook.it"
__version__ = "2021.09.17"

ghenv.Component.Name = "3D Domain (Alpaca4d)"
ghenv.Component.NickName = '3DD'
ghenv.Component.Message = "3D Domain (Alpaca4d)"

ghcompfolder = gh.Folders.DefaultAssemblyFolder
if ghcompfolder not in sys.path:
    sys.path.append(ghcompfolder)

try:
    from Alpaca4d import alpaca4d as alpaca
except:
    msg = "Cannot import Alpaca4d. Is the Alpaca4d folder available in " + ghcompfolder + "?"
    ghenv.Component.AddRuntimeMessage(gh.Kernel.GH_RuntimeMessageLevel.Error, msg)


checkData = True



if not FiberSection:
    checkData = False
    msg = "Input parameter AlpacaModel failed to collect data"
    ghenv.Component.AddRuntimeMessage(gh.Kernel.GH_RuntimeMessageLevel.Warning, msg)

def linspace(start, stop, len):
    step = (mt.fabs(start)+stop)/(len-1)
    return [start + step*interval for interval in range(len)]

def RunMCpositive(Pi): 
    if Pi > 0.0:
        recorderFileName = "MKsectionP{}positiveMpositive".format(int(mt.fabs(Pi)))
        outputFileName = "OSSModel{}positiveMpositive".format(int(mt.fabs(Pi)))
    elif Pi < 0.0:
        recorderFileName = "MKsectionP{}negativeMpositive".format(int(mt.fabs(Pi)))
        outputFileName = "OSSModel{}negativeMpositive".format(int(mt.fabs(Pi)))
        
    alpha = linspace(0,360, 36)
    
    
    listN = []
    listM1 = []
    listM2 = []
    for alphai in alpha:
        MC = alpaca.MomentCurvature(recorderFileName,FiberSection, float(Pi), alphai, 2.0, 1000) #mu*FiberSection.Ky
        script = MC.write_tcl()
    
        FolderPath = rs.DocumentPath()
        os.chdir(FolderPath)
        
        recorderFileName1 = recorderFileName + "Force" + ".out"
        recorderFileName2 = recorderFileName + "Disp" + ".out"
    
        runFileName = os.path.join(FolderPath,outputFileName)
        filepath1 = os.path.join(FolderPath,recorderFileName1)
        #filepath2 = os.path.join(FolderPath,recorderFileName2)
        time_start = time.clock()
    
        with open(outputFileName, 'w') as f:
            for line in MC.write_tcl():
                f.write(line)
            f.close()
    
        time_elapsed = (time.clock() - time_start)
        #print("Writing Time {}".format(time_elapsed))
        
        time_start = time.clock()
        
        executable = os.path.join(ghcompfolder,'Alpaca4d\OpenSees-Solvers\opensees.bat')
        #executable = os.path.join(ghcompfolder,'C:\OpenSees\bin\opensees.bat')
        
        #process = subprocess.Popen([r'C:\OpenSees\bin\OpenSees', outputFileName], shell = True, stdout=subprocess.PIPE, stderr=subprocess.PIPE)
        process = subprocess.Popen([executable, outputFileName], shell = True,  stdout=subprocess.PIPE, stderr=subprocess.PIPE)
        stdout, stderr = process.communicate()
        #print(stdout, stderr)
        process.kill()
        os.remove(runFileName)
        time_elapsed = (time.clock() - time_start)
        #print("Analyses Time {}".format(time_elapsed))
        #filepath = os.path.join(r'C:\OpenSees\bin',recorderFileName)
        fileObj = open(filepath1, 'r')
        words = fileObj.read().splitlines(" ")
        #print(fileObj.read())
        N = "None"
        if len(words) != 0:
            N = float(words[-1].split()[0])
            M1 = float(words[-1].split()[1])
            M2 = float(words[-1].split()[2])
            
            listN.append(N)
            listM1.append(M1)
            listM2.append(M2)
        fileObj.close()

        os.remove(filepath1)
    """
    fileObj = open(filepath2, 'r')
    words = fileObj.read().splitlines(" ")
    #print(fileObj.read())

    k1 = [ float(i.split()[1]) for i in words]
    k2 = [ float(i.split()[2]) for i in words]
    k3 = [ float(i.split()[3]) for i in words]
    fileObj.close()
    """
        #os.remove(filepath2)
    if N != "None" :
        return [listN, listM1, listM2]

        
if checkData:
    FiberSection.secTag = 1
    for i, item in enumerate(FiberSection.path):
        item.material.matTag = 2*(i+1)
        item.material.matTagMinMax = 2*i+1
        #print(item.material.matTag )
    j = i+2
    for i, item in enumerate(FiberSection.layer):
        j = j + i 
        item.material.matTag = 2*(j+1)
        item.material.matTagMinMax = 2*j+1
        #print(j+i)
    w = j+2
    for i, item in enumerate(FiberSection.fiber):
        w = w + i 
        item.material.matTag = 2*(w+1)
        item.material.matTagMinMax = 2*w+1
        
    #A = ghp.run(RunNEps,[-1.0, 1.0], True)
    
    
    
        
    print(FiberSection.NultNeg+0.1*FiberSection.NultNeg,FiberSection.NultPos)
    
    
    #n1 = int(mt.fabs(min(A)/stepValorPositive))
    #n2 = int(mt.fabs(max(A)/stepValorNegative))
    
    #listP = linspace(min(A), -5.0, n1) + linspace(5, max(A)-10.0, n2)
    
    
        
    listP = linspace(FiberSection.NultNeg,FiberSection.NultPos, nPoint)
    
    
    B = ghp.run(RunMCpositive, listP,False)
    B =filter(None, B)
    #C = ghp.run(RunMCnegative, listP,False)
    
    #print(B[1])
    #RunM1Cpositive(Pi): 
    
    N, M1, M2 = [], [], []
    
    for item in B:
        #item =filter(None, item) #elimino il None
        N.append(item[0])
        M1.append(item[1])
        M2.append(item[2])
    
    
    N, M1, M2 = th.list_to_tree(N), th.list_to_tree(M1), th.list_to_tree(M2)
    
    
    
    """
    for item in B:
        Nupos.append(item[0])
        M1uP.append( item[1])
        M2uP.append( item[2])
        #M3uP.append( item[3])
        
    for item in C:
        Nuneg.append(item[0])
        M1uN.append( item[1])
        M2uN.append( item[2])
    
    M1 = M1uN + M1uP[::-1] + M1uN[0:1]
    M2 = M2uN + M2uP[::-1] + M2uN[0:1]
    N = Nuneg + Nupos[::-1] + Nuneg[0:1]
    
    if direction == 1:
        M = M2
    else:
        M = M1
    """
# ---------- end _3dd ----------
mnm_3 = MNModelAlpaca4d()  # -> out, N, M; inputs nPoint: Int32
# ---------- mnm_3: Python ----------
"""
Run an OpenSees Analysis
-
    Args:
        FiberSection:
        direction: 1 for M2 and 2 for M1. Default is 1 
        nPoint: number of Point for make de N-M domain
    Returns:
        N: axial load valor
        M: bending moment valor
"""



import Rhino.RhinoDoc
import Grasshopper as gh
import copy
import rhinoscriptsyntax as rs
import Rhino.Geometry as rg
import os
import time
import sys
import subprocess
import ghpythonlib.treehelpers as th
import math as mt
import ghpythonlib.parallel as ghp


__author__ = "Ing. Domenico Gaudioso"
__contact__ = "DomenicoGaudioso@outlook.it"
__version__ = "2021.09.17"

ghenv.Component.Name = "M-N Model (Alpaca4d)"
ghenv.Component.NickName = 'MNM'
ghenv.Component.Message = "M-N Model (Alpaca4d)"

ghcompfolder = gh.Folders.DefaultAssemblyFolder
if ghcompfolder not in sys.path:
    sys.path.append(ghcompfolder)

try:
    from Alpaca4d import alpaca4d as alpaca
except:
    msg = "Cannot import Alpaca4d. Is the Alpaca4d folder available in " + ghcompfolder + "?"
    ghenv.Component.AddRuntimeMessage(gh.Kernel.GH_RuntimeMessageLevel.Error, msg)


checkData = True


if not FiberSection:
    checkData = False
    msg = "Input parameter AlpacaModel failed to collect data"
    ghenv.Component.AddRuntimeMessage(gh.Kernel.GH_RuntimeMessageLevel.Warning, msg)
    
if direction == None:
    direction = 1
    
def linspace(start, stop, len):
    step = (mt.fabs(start)+stop)/(len-1)
    return [start + step*interval for interval in range(len)]
        
def RunMCpositive(Pi): 
    if Pi > 0.0:
        recorderFileName = "MKsectionP{}positiveMpositive".format(int(mt.fabs(Pi)))
        outputFileName = "OSSModel{}positiveMpositive".format(int(mt.fabs(Pi)))
    elif Pi < 0.0:
        recorderFileName = "MKsectionP{}negativeMpositive".format(int(mt.fabs(Pi)))
        outputFileName = "OSSModel{}negativeMpositive".format(int(mt.fabs(Pi)))
        
    if direction == 1:
        alpha = 0.0
    else:
        alpha = 90.0
            
    MC = alpaca.MomentCurvature(recorderFileName,FiberSection, float(Pi), alpha, 2.0, 1000) #mu*FiberSection.Ky
    script = MC.write_tcl()
    
    FolderPath = rs.DocumentPath()
    os.chdir(FolderPath)
        
    recorderFileName1 = recorderFileName + "Force" + ".out"
    recorderFileName2 = recorderFileName + "Disp" + ".out"
    
    runFileName = os.path.join(FolderPath,outputFileName)
    filepath1 = os.path.join(FolderPath,recorderFileName1)
    #filepath2 = os.path.join(FolderPath,recorderFileName2)
    """
    if os.path.exists(runFileName):
      os.remove(runFileName)
      os.remove(filepath1)
      os.remove(filepath1)
    else:
      print("The file does not exist")
    """
    time_start = time.clock()
    
    with open(outputFileName, 'w') as f:
        for line in MC.write_tcl():
            f.write(line)
        f.close()
    
    time_elapsed = (time.clock() - time_start)
    #print("Writing Time {}".format(time_elapsed))
    
    time_start = time.clock()
    
    executable = os.path.join(ghcompfolder,'Alpaca4d\OpenSees-Solvers\opensees.bat')
    #executable = os.path.join(ghcompfolder,'C:\OpenSees\bin\opensees.bat')
    
    #process = subprocess.Popen([r'C:\OpenSees\bin\OpenSees', outputFileName], shell = True, stdout=subprocess.PIPE, stderr=subprocess.PIPE)
    process = subprocess.Popen([executable, outputFileName], shell = True,  stdout=subprocess.PIPE, stderr=subprocess.PIPE)
    stdout, stderr = process.communicate()
    #print(stdout, stderr)
    process.kill()
    os.remove(runFileName)
    time_elapsed = (time.clock() - time_start)
    #print("Analyses Time {}".format(time_elapsed))
    #filepath = os.path.join(r'C:\OpenSees\bin',recorderFileName)
    fileObj = open(filepath1, 'r')
    words = fileObj.read().splitlines(" ")
    #print(fileObj.read())
    N = "None"
    if len(words) != 0:
        N = float(words[-1].split()[0])
        M1 = float(words[-1].split()[1])
        M2 = float(words[-1].split()[2])
    fileObj.close()

    os.remove(filepath1)
    """
    fileObj = open(filepath2, 'r')
    words = fileObj.read().splitlines(" ")
    #print(fileObj.read())

    k1 = [ float(i.split()[1]) for i in words]
    k2 = [ float(i.split()[2]) for i in words]
    k3 = [ float(i.split()[3]) for i in words]
    fileObj.close()
    """
    #os.remove(filepath2)
    if N != "None" :
        return [N, M1, M2]


def RunMCnegative(Pi): 

    if Pi > 0.0:
        recorderFileName = "MKsectionP{}positiveMnegative".format(int(mt.fabs(Pi)))
        outputFileName = "OSSModel{}positiveMnegative".format(int(mt.fabs(Pi)))
    elif Pi < 0.0:
        recorderFileName = "MKsectionP{}negativeMnegative".format(int(mt.fabs(Pi)))
        outputFileName = "OSSModel{}negativeMnegative".format(int(mt.fabs(Pi)))
        
    if direction == 1:
        alpha = 180.00
    else:
        alpha = 270.00
            
    MC = alpaca.MomentCurvature(recorderFileName,FiberSection, float(Pi), alpha, 2.0, 1000)
    script = MC.write_tcl()
    
    FolderPath = rs.DocumentPath()
    os.chdir(FolderPath)
        
    recorderFileName1 = recorderFileName + "Force" + ".out"
    recorderFileName2 = recorderFileName + "Disp" + ".out"
    
    runFileName = os.path.join(FolderPath,outputFileName)
    filepath1 = os.path.join(FolderPath,recorderFileName1)
    #filepath2 = os.path.join(FolderPath,recorderFileName2)
    """
    if os.path.exists(runFileName):
      os.remove(runFileName)
      os.remove(filepath1)
      os.remove(filepath1)
    else:
      print("The file does not exist")
      """
    time_start = time.clock()
    
    with open(outputFileName, 'w') as f:
        for line in MC.write_tcl():
            f.write(line)
        f.close()
    
    time_elapsed = (time.clock() - time_start)
    #print("Writing Time {}".format(time_elapsed))
    
    time_start = time.clock()
    
    executable = os.path.join(ghcompfolder,'Alpaca4d\OpenSees-Solvers\opensees.bat')
    #executable = os.path.join(ghcompfolder,'C:\OpenSees\bin\opensees.bat')
    
    #process = subprocess.Popen([r'C:\OpenSees\bin\OpenSees', outputFileName], shell = True, stdout=subprocess.PIPE, stderr=subprocess.PIPE)
    process = subprocess.Popen([executable, outputFileName], shell = True,  stdout=subprocess.PIPE, stderr=subprocess.PIPE)
    stdout, stderr = process.communicate()
    #print(stdout, stderr)
    process.kill()
    os.remove(runFileName)
    time_elapsed = (time.clock() - time_start)
    #print("Analyses Time {}".format(time_elapsed))
    #filepath = os.path.join(r'C:\OpenSees\bin',recorderFileName)
    fileObj = open(filepath1, 'r')
    words = fileObj.read().splitlines(" ")
    #print(fileObj.read())
    N = "None"
    if len(words) != 0:
        N = float(words[-1].split()[0])
        M1 = float(words[-1].split()[1])
        M2 = float(words[-1].split()[2])
    fileObj.close()

    os.remove(filepath1)
    """
    fileObj = open(filepath2, 'r')
    words = fileObj.read().splitlines(" ")
    #print(fileObj.read())

    k1 = [ float(i.split()[1]) for i in words]
    k2 = [ float(i.split()[2]) for i in words]
    k3 = [ float(i.split()[3]) for i in words]
    fileObj.close()
    """
    #os.remove(filepath2)
    if N != "None" :
        return [N, M1, M2]
        
        

if checkData:
    centerForce = rg.Point3d(FiberSection.centerSection.X, FiberSection.centerSection.Y, FiberSection.centerSection.Z)
### ASSEMBLE ###
    FiberSection.secTag = 1
    for i, item in enumerate(FiberSection.path):
        item.material.matTag = 2*(i+1)
        item.material.matTagMinMax = 2*i+1
        #print(item.material.matTag )
    j = i+2
    for i, item in enumerate(FiberSection.layer):
        j = j + i 
        item.material.matTag = 2*(j+1)
        item.material.matTagMinMax = 2*j+1
        #print(j+i)
    w = j+2
    for i, item in enumerate(FiberSection.fiber):
        w = w + i 
        item.material.matTag = 2*(w+1)
        item.material.matTagMinMax = 2*w+1
        
#A = ghp.run(RunNEps,[-1.0, 1.0], True)

        
    print(FiberSection.NultNeg+0.1*FiberSection.NultNeg,FiberSection.NultPos)
    
    
    #n1 = int(mt.fabs(min(A)/stepValorPositive))
    #n2 = int(mt.fabs(max(A)/stepValorNegative))
    
    #listP = linspace(min(A), -5.0, n1) + linspace(5, max(A)-10.0, n2)
    
    if nPoint == None:
        nPoint = 10
        
    listP = linspace(FiberSection.NultNeg,FiberSection.NultPos, nPoint)
    
    
    B = ghp.run(RunMCpositive, listP,False)
    C = ghp.run(RunMCnegative, listP,False)
    
    #print(D[7])
    #RunM1Cpositive(Pi): 
    
    
    Nupos, Nuneg = [], []
    M1uP, M2uP = [], []
    M1uN, M2uN = [], []
    
    B =filter(None, B) #elimino il None
    C =filter(None, C) 
    
    for item in B:
        Nupos.append(item[0])
        M1uP.append( item[1])
        M2uP.append( item[2])
        #M3uP.append( item[3])
        
    for item in C:
        Nuneg.append(item[0])
        M1uN.append( item[1])
        M2uN.append( item[2])
    
    M1 = M1uN + M1uP[::-1] + M1uN[0:1]
    M2 = M2uN + M2uP[::-1] + M2uN[0:1]
    N = Nuneg + Nupos[::-1] + Nuneg[0:1]
    
    if direction == 1:
        M = M2
    else:
        M = M1
# ---------- end mnm_3 ----------
dm1m2_2 = DomainM1M2Alpaca4d()  # -> out, N, M1, M2; inputs nPoint: Int32
# ---------- dm1m2_2: Python ----------
"""
Run an OpenSees Analysis
-
    Args:
        FiberSection:
        direction: 1 for M2 and 2 for M1. Default is 1 
        nPoint: number of Point for make de N-M domain
    Returns:
        N: axial load valor
        M: bending moment valor
"""



import Rhino.RhinoDoc
import Grasshopper as gh
import copy
import rhinoscriptsyntax as rs
import Rhino.Geometry as rg
import os
import time
import sys
import subprocess
import ghpythonlib.treehelpers as th
import math as mt
import ghpythonlib.parallel as ghp


__author__ = "Ing. Domenico Gaudioso"
__contact__ = "DomenicoGaudioso@outlook.it"
__version__ = "2021.09.17"

ghenv.Component.Name = "Domain M1 M2 (Alpaca4d)"
ghenv.Component.NickName = 'DM1M2'
ghenv.Component.Message = "Domain M1 M2 (Alpaca4d)"

ghcompfolder = gh.Folders.DefaultAssemblyFolder
if ghcompfolder not in sys.path:
    sys.path.append(ghcompfolder)

try:
    from Alpaca4d import alpaca4d as alpaca
except:
    msg = "Cannot import Alpaca4d. Is the Alpaca4d folder available in " + ghcompfolder + "?"
    ghenv.Component.AddRuntimeMessage(gh.Kernel.GH_RuntimeMessageLevel.Error, msg)


checkData = True

if not FiberSection:
    checkData = False
    msg = "Input parameter AlpacaModel failed to collect data"
    ghenv.Component.AddRuntimeMessage(gh.Kernel.GH_RuntimeMessageLevel.Warning, msg)


def linspace(start, stop, len):
    step = (mt.fabs(start)+stop)/(len-1)
    return [start + step*interval for interval in range(len)]


def RunMCpositive(Pi): 
    if Pi > 0.0:
        recorderFileName = "MKsectionP{}positiveMpositive".format(int(mt.fabs(Pi)))
        outputFileName = "OSSModel{}positiveMpositive".format(int(mt.fabs(Pi)))
    elif Pi < 0.0:
        recorderFileName = "MKsectionP{}negativeMpositive".format(int(mt.fabs(Pi)))
        outputFileName = "OSSModel{}negativeMpositive".format(int(mt.fabs(Pi)))
    
    if nPoint == None:
        alpha = linspace(0,360, 36)
    else :
        alpha = linspace(0,360, nPoint)
   
        
    listN = []
    listM1 = []
    listM2 = []
    for alphai in alpha:
        MC = alpaca.MomentCurvature(recorderFileName,FiberSection, float(Pi), alphai, 2.0, 1000) #mu*FiberSection.Ky
        script = MC.write_tcl()
    
        FolderPath = rs.DocumentPath()
        os.chdir(FolderPath)
        
        recorderFileName1 = recorderFileName + "Force" + ".out"
        recorderFileName2 = recorderFileName + "Disp" + ".out"
    
        runFileName = os.path.join(FolderPath,outputFileName)
        filepath1 = os.path.join(FolderPath,recorderFileName1)
        #filepath2 = os.path.join(FolderPath,recorderFileName2)
        time_start = time.clock()
    
        with open(outputFileName, 'w') as f:
            for line in MC.write_tcl():
                f.write(line)
            f.close()
    
        time_elapsed = (time.clock() - time_start)
        #print("Writing Time {}".format(time_elapsed))
        
        time_start = time.clock()
        
        executable = os.path.join(ghcompfolder,'Alpaca4d\OpenSees-Solvers\opensees.bat')
        #executable = os.path.join(ghcompfolder,'C:\OpenSees\bin\opensees.bat')
        
        #process = subprocess.Popen([r'C:\OpenSees\bin\OpenSees', outputFileName], shell = True, stdout=subprocess.PIPE, stderr=subprocess.PIPE)
        process = subprocess.Popen([executable, outputFileName], shell = True,  stdout=subprocess.PIPE, stderr=subprocess.PIPE)
        stdout, stderr = process.communicate()
        #print(stdout, stderr)
        process.kill()
        os.remove(runFileName)
        time_elapsed = (time.clock() - time_start)
        #print("Analyses Time {}".format(time_elapsed))
        #filepath = os.path.join(r'C:\OpenSees\bin',recorderFileName)
        fileObj = open(filepath1, 'r')
        words = fileObj.read().splitlines(" ")
        #print(fileObj.read())
        N = "None"
        if len(words) != 0:
            N = float(words[-1].split()[0])
            M1 = float(words[-1].split()[1])
            M2 = float(words[-1].split()[2])
            
            listN.append(N)
            listM1.append(M1)
            listM2.append(M2)
        fileObj.close()

        os.remove(filepath1)
    """
    fileObj = open(filepath2, 'r')
    words = fileObj.read().splitlines(" ")
    #print(fileObj.read())

    k1 = [ float(i.split()[1]) for i in words]
    k2 = [ float(i.split()[2]) for i in words]
    k3 = [ float(i.split()[3]) for i in words]
    fileObj.close()
    """
        #os.remove(filepath2)
    if N != "None" :
        return [listN, listM1, listM2]


        
if checkData:
    FiberSection.secTag = 1
    for i, item in enumerate(FiberSection.path):
        item.material.matTag = 2*(i+1)
        item.material.matTagMinMax = 2*i+1
        #print(item.material.matTag )
    j = i+2
    for i, item in enumerate(FiberSection.layer):
        j = j + i 
        item.material.matTag = 2*(j+1)
        item.material.matTagMinMax = 2*j+1
        #print(j+i)
    w = j+2
    for i, item in enumerate(FiberSection.fiber):
        w = w + i 
        item.material.matTag = 2*(w+1)
        item.material.matTagMinMax = 2*w+1
        
    #A = ghp.run(RunNEps,[-1.0, 1.0], True)
    
    
    
        
    print(FiberSection.NultNeg+0.1*FiberSection.NultNeg,FiberSection.NultPos)
    
    
    #n1 = int(mt.fabs(min(A)/stepValorPositive))
    #n2 = int(mt.fabs(max(A)/stepValorNegative))
    
    #listP = linspace(min(A), -5.0, n1) + linspace(5, max(A)-10.0, n2)
    
    
    if axialLoad == None:
        axialLoad = 0.1
    B = ghp.run(RunMCpositive, [axialLoad],False)
    B =filter(None, B)
    #C = ghp.run(RunMCnegative, listP,False)
    
    #print(B[1])
    #RunM1Cpositive(Pi): 
    
    N, M1, M2 = [], [], []
    
    for item in B:
        #item =filter(None, item) #elimino il None
        N.append(item[0])
        M1.append(item[1])
        M2.append(item[2])
    
    
    N, M1, M2 = th.list_to_tree(N), th.list_to_tree(M1), th.list_to_tree(M2)
    
    
    
    """
    for item in B:
        Nupos.append(item[0])
        M1uP.append( item[1])
        M2uP.append( item[2])
        #M3uP.append( item[3])
        
    for item in C:
        Nuneg.append(item[0])
        M1uN.append( item[1])
        M2uN.append( item[2])
    
    M1 = M1uN + M1uP[::-1] + M1uN[0:1]
    M2 = M2uN + M2uP[::-1] + M2uN[0:1]
    N = Nuneg + Nupos[::-1] + Nuneg[0:1]
    
    if direction == 1:
        M = M2
    else:
        M = M1
    """
# ---------- end dm1m2_2 ----------
panel_10 = Panel(mnm_2.N)
bnd = Bounds(Numbers=mnm.M1)
panel_11 = Panel(mnm.M1)
panel_12 = Panel(mnm_2.M)
dedomain = DeconstructDomain(Domain=bnd)  # -> Start, End
gradient = Gradient(
    LowerLimit=dedomain.Start,
    UpperLimit=dedomain.End,
    Parameter=mnm.M1,
    stops=[0: RGB(234, 38, 0), 0.25: RGB(234, 126, 0), 0.5: RGB(254, 244, 84), 0.75: RGB(173, 203, 249), 1: RGB(75, 107, 169)])
multiplication_14 = Multiplication(A=mnm_2.N, B=Slider(0.004, range=0..0.01))
multiplication_15 = Multiplication(A=mnm_2.M, B=Slider(0.1, range=0.001..5))
demesh = DeconstructMesh(Mesh=P.pathSurf)  # -> Vertices, graft(Faces), Colours, Normals
pt_3 = ConstructPoint(XCoordinate=multiplication_14, YCoordinate=multiplication_15, ZCoordinate=0)
number_slider_6 = Slider(1582, range=0..10000)
intcrv = Interpolate(Vertices=pt_3, Degree=3, Periodic=False, KnotStyle=1)  # -> Curve, Length, Domain
multiplication_16 = Multiplication(A=demesh.Normals, B=mnm.M1)
conmesh = ConstructMesh(Vertices=demesh.Vertices, Faces=demesh.Faces, Colours=graft(gradient))
multiplication_17 = Multiplication(A=multiplication_16, B=Slider(100, range=0..100))
vdisex = VectorDisplayEx(Point=facen.Centers, Vector=multiplication_17, Colour=gradient, Width="4")
gh_cpython = GH_CPython(data_X=mnm_2.N, data_Y=mnm_2.M, name_AxisX=<missing>, name_AxisY=<missing>, title=<missing>, NameSave=<missing>)  # -> output, pathSave; inputs data_X: list, data_Y: list, name_AxisX: list, name_AxisY: list, title: list, NameSave: list; disabled
# ---------- gh_cpython: Python ----------
# -*- coding: utf-8 -*-
""" 
Python Script
Created on  Saturday August 2021 05:11:41 
@author:  Domen 

[desc]
Description of the plugin Here
Write here any thing... 
[/desc]

ARGUMENTS:
----------
<inp> 
    _input :[required] - [type = int] - [default = None] 
    Descripe your input here 
        * bullet point.
        * bullet point
</inp>
<inp>
    Other inputs go here ...
</inp>

RETURN:
----------
    <out>
        output_ : indicate your output description here. \n refers to a new line.
    </out>

"""
import matplotlib.pyplot as plt
import numpy as np
import os

print('getcwd:      ', os.getcwd())
print('__file__:    ', __file__)

pathSave = os.path.join(os.getcwd(), "NameSave"+ ".png")
 
# Data for plotting
t = data_X
s = data_Y


fig, ax = plt.subplots()
ax.plot(t, s, '.-')

ax.set(xlabel=name_AxisX, ylabel=name_AxisY,
       title=title)
ax.grid()
fig.set_size_inches(3, 3)
fig.savefig(NameSave +".png")
#plt.savefig(pathSave)
# ---------- end gh_cpython ----------
gh_cpython_2 = GH_CPython(
    data_X=flatten(<missing>),
    data_Y=flatten(<missing>),
    data_Z=flatten(<missing>),
    name_AxisX=<missing>,
    name_AxisY=<missing>,
    title=<missing>,
    NameSave=<missing>)  # -> output, pathSave; inputs data_X: list, data_Y: list, data_Z: list, name_AxisX: list, name_AxisY: list, title: list, NameSave: list; disabled
# ---------- gh_cpython_2: Python ----------
# -*- coding: utf-8 -*-
""" 
Python Script
Created on  Saturday August 2021 05:11:41 
@author:  Domen 

[desc]
Description of the plugin Here
Write here any thing... 
[/desc]

ARGUMENTS:
----------
<inp> 
    _input :[required] - [type = int] - [default = None] 
    Descripe your input here 
        * bullet point.
        * bullet point
</inp>
<inp>
    Other inputs go here ...
</inp>

RETURN:
----------
    <out>
        output_ : indicate your output description here. \n refers to a new line.
    </out>

"""
import matplotlib.pyplot as plt
import numpy as np
import os
from mpl_toolkits import mplot3d


print('getcwd:      ', os.getcwd())
print('__file__:    ', __file__)

pathSave = os.path.join(os.getcwd(), "NameSave"+ ".png")
 
# Data for plotting
x = data_X
y = data_Y
z = data_Z

X, Y = np.meshgrid(x, y)

#X=[i for n in x for i in n]
#Y=[i for n in y for i in n]


fig = plt.figure()
# syntax for 3-D plotting
ax = plt.axes(projection ='3d')

# syntax for plotting
#ax.scatter(X, Y, Z, c = z, cmap ='viridis')
ax.scatter(x, y, z, c = z, cmap ='viridis')
#ax.plot_surface(X, Y, z, cmap ='viridis', edgecolor ='green')
#ax.set_title('Surface plot geeks for geeks')
fig.savefig(title +".png")
#plt.show()
#plt.savefig(pathSave)
# ---------- end gh_cpython_2 ----------
gh_cpython_3 = GH_CPython(data_X=dm1m2.M1, data_Y=dm1m2.M2, name_AxisX=<missing>, name_AxisY=<missing>, title=<missing>, NameSave=<missing>)  # -> output, pathSave; inputs data_X: list, data_Y: list, name_AxisX: list, name_AxisY: list, title: list, NameSave: list; disabled
# ---------- gh_cpython_3: Python ----------
# -*- coding: utf-8 -*-
""" 
Python Script
Created on  Saturday August 2021 05:11:41 
@author:  Domen 

[desc]
Description of the plugin Here
Write here any thing... 
[/desc]

ARGUMENTS:
----------
<inp> 
    _input :[required] - [type = int] - [default = None] 
    Descripe your input here 
        * bullet point.
        * bullet point
</inp>
<inp>
    Other inputs go here ...
</inp>

RETURN:
----------
    <out>
        output_ : indicate your output description here. \n refers to a new line.
    </out>

"""
import matplotlib.pyplot as plt
import numpy as np
import os

print('getcwd:      ', os.getcwd())
print('__file__:    ', __file__)

pathSave = os.path.join(os.getcwd(), "NameSave"+ ".png")
 
# Data for plotting
t = data_X
s = data_Y


fig, ax = plt.subplots()
ax.plot(t, s, '.-')

ax.set(xlabel=name_AxisX, ylabel=name_AxisY,
       title=title)
ax.grid()
fig.set_size_inches(3, 3)
fig.savefig(title +".png")
#plt.savefig(pathSave)
# ---------- end gh_cpython_3 ----------
gh_cpython_4 = GH_CPython(name_AxisX=<missing>, name_AxisY=<missing>, title=<missing>, NameSave=<missing>)  # -> output, pathSave; inputs data_X: list, data_Y: list, name_AxisX: list, name_AxisY: list, legend: list, title: list, NameSave: list; disabled
# ---------- gh_cpython_4: Python ----------
# -*- coding: utf-8 -*-
""" 
Python Script
Created on  Saturday August 2021 05:11:41 
@author:  Domen 

[desc]
Description of the plugin Here
Write here any thing... 
[/desc]

ARGUMENTS:
----------
<inp> 
    _input :[required] - [type = int] - [default = None] 
    Descripe your input here 
        * bullet point.
        * bullet point
</inp>
<inp>
    Other inputs go here ...
</inp>

RETURN:
----------
    <out>
        output_ : indicate your output description here. \n refers to a new line.
    </out>

"""
import matplotlib.pyplot as plt
import numpy as np
import os

print('getcwd:      ', os.getcwd())
print('__file__:    ', __file__)

pathSave = os.path.join(os.getcwd(), "NameSave"+ ".png")
 
# Data for plotting
t = data_X
s = data_Y



fig, ax = plt.subplots()
for itemX, itemY, Ilegend in zip(t, s, legend):
    ax.plot(itemX, itemY, label ='axis load = ' + str(Ilegend))

ax.set(xlabel=name_AxisX, ylabel=name_AxisY,
       title=title)

ax.legend(loc ="lower right")
ax.grid()

fig.savefig(title +".png")
#plt.savefig(pathSave)
# ---------- end gh_cpython_4 ----------
gh_cpython_5 = GH_CPython(data_X=<missing>, data_Y=<missing>, name_AxisX=<missing>, name_AxisY=<missing>, title=<missing>, NameSave=<missing>)  # -> output, pathSave; inputs data_X: list, data_Y: list, name_AxisX: list, name_AxisY: list, title: list, NameSave: list
# ---------- gh_cpython_5: Python ----------
# -*- coding: utf-8 -*-
""" 
Python Script
Created on  Saturday August 2021 05:11:41 
@author:  Domen 

[desc]
Description of the plugin Here
Write here any thing... 
[/desc]

ARGUMENTS:
----------
<inp> 
    _input :[required] - [type = int] - [default = None] 
    Descripe your input here 
        * bullet point.
        * bullet point
</inp>
<inp>
    Other inputs go here ...
</inp>

RETURN:
----------
    <out>
        output_ : indicate your output description here. \n refers to a new line.
    </out>

"""
import matplotlib.pyplot as plt
import numpy as np
import os

print('getcwd:      ', os.getcwd())
print('__file__:    ', __file__)

pathSave = os.path.join(os.getcwd(), "NameSave"+ ".png")
 
# Data for plotting
t = data_X
s = data_Y


fig, ax = plt.subplots()
ax.plot(t, s)

ax.set(xlabel=name_AxisX, ylabel=name_AxisY,
       title=title)
ax.grid()

fig.savefig(title +".png")
#plt.savefig(pathSave)
# ---------- end gh_cpython_5 ----------
